# Grasshopper definition 001_ChristmasTree.gh (Grasshopper 1.0.7)
# plug-ins: Pufferfish, LunchBox, CORE.Grasshopper.Colibri, Human

# ---- group: Main Parameters
present_height_seed = Slider(10, range=0..10)
present_count = Slider(35, range=35..50)
bcircle_diameter = Slider(12, range=11..15)
scircle_multiplier = Slider(85, range=80..90)
tree_height = Slider(0.75, range=0.7..0.85)
tree_segments = Slider(8, range=5..8)

# ----
button = Button()
version = Slider(30, range=0..100)
construct_domain = ConstructDomain(DomainStart="0", DomainEnd="619520")
random = Random(Range=construct_domain, Number=version, Seed=2)
integer = Integer(random)
construct_domain_2 = ConstructDomain(DomainStart=integer, DomainEnd=integer)
colibri_iteration_subdomain = ColibriIterationSubdomain(Domain=construct_domain_2)
colibri_inputs_iterator = ColibriInputsIterator(
    RemoteFly=button,
    Selection=colibri_iteration_subdomain,
    Present_Count=present_count,
    BCircle_Diameter=bcircle_diameter,
    SCircle_Multiplier=scircle_multiplier,
    Tree_Height=tree_height,
    Tree_Segments=tree_segments,
    Present_Height_Seed=present_height_seed,
    ignoreAllWarningMsg=True)  # -> Unique_Name, Inputs, Present_Count, BCircle_Diameter, SCircle_Multiplier, Tree_Height, Tree_Segments, Present_Height_Seed, V_N
panel = Panel(colibri_inputs_iterator.Unique_Name)
toggle = BooleanToggle(True)  # disabled
panel_2 = Panel("C:\Users\atabe\OneDrive\Masaüstü\ChristmasTree\Raw")  # disabled
concatenate = Concatenate(FragmentA="\", FragmentB=colibri_inputs_iterator.Unique_Name)
file_path = FilePath("C:\Users\atabe\OneDrive\Masaüstü\ChristmasTree\Raw")
c_name_iterator = CSharpScript(T=toggle, R=button, P=panel_2)  # -> out, A; inputs T: Boolean, R: Boolean; disabled
# ---------- c_name_iterator: C# ----------
    if(T)
    {
      n++;
    }
    if(R)
    {
      n = 0;
    }
    A = P + "_" + n + ".jpg";
# ---------- c_name_iterator: C# additional code ----------
  public int n;
# ---------- end c_name_iterator ----------
panel_3 = Panel(c_name_iterator.A)  # disabled
concatenate_2 = Concatenate(FragmentA=file_path, FragmentB=concatenate)
concatenate_3 = Concatenate(FragmentA=concatenate_2, FragmentB=".png")
c_vp_to_img = CSharpScript(T=toggle, P=c_name_iterator.A)  # inputs T: Boolean, P: String; disabled
# ---------- c_vp_to_img: C# ----------
    if(T)
    {
      var file_name = "";
      if (P != "")
      {
        file_name = P;
        var bitmap = RhinoDoc.ActiveDoc.Views.ActiveView.CaptureToBitmap(false, false, false);
        //Clipboard.SetImage(bitmap);
        bitmap.Save(file_name);
      }
    }
# ---------- end c_vp_to_img ----------
save_viewport_to_file = SaveViewportToFile(Run=Toggle(True), ViewportName="View", Render=False, FilePath=concatenate_3, ScaleFactor=1)

# ----
# Main Tree
number_slider = Slider(1, range=0.05..1)
series = Series(Start=number_slider, Step=tree_height, Count=tree_segments)
multiplication = Multiplication(A=series, B=Slider(0.114, range=0..1))
number_slider_2 = Slider(1.169, range=1..2)  # disabled
addition = Addition(A=multiplication, B=tree_height)
mass_addition = MassAddition(Input=addition)  # -> Result, PartialResults
expression = Expression(r=number_slider_2, d=tree_height, x=series, Expression="d*(r^x)")  # disabled
mass_addition_2 = MassAddition(Input=expression)  # -> Result, PartialResults; disabled
multiplication_2 = Multiplication(A=mass_addition.PartialResults, B=Slider(37, range=0..100))
construct_point = ConstructPoint(XCoordinate=0, YCoordinate=0, ZCoordinate=multiplication_2)
negative = Negative(Value=Slider(15, range=0..50))
unit_z = UnitZ(Factor=negative)
series_2 = Series(Start=Slider(1, range=0..10), Step=bcircle_diameter, Count=tree_segments)
percentage = Percentage(Number=series_2, Percent=scircle_multiplier)
move = Move(Geometry=construct_point, Motion=unit_z)  # -> Geometry, Transform
circle = Circle(Plane=move.Geometry, Radius=reverse(percentage))
list_length = ListLength(List=circle)
expression_2 = Expression(x=list_length, Expression="x-1")
list_item = ListItem(List=circle, Index=expression_2, Wrap=True)
merge = Merge(Data1="0", Data2=expression_2)
circle_2 = Circle(Plane=construct_point, Radius=reverse(series_2))
cull_index = CullIndex(List=circle, Indices=flatten(merge), Wrap=True)
list_item_2 = ListItem(List=circle, Index=expression_2, Wrap=True)
list_length_2 = ListLength(List=circle_2)
expression_3 = Expression(x=list_length_2, Expression="x-1")
cull_index_2 = CullIndex(List=circle_2, Indices=flatten(expression_3), Wrap=True)
loft_options = LoftOptions(Closed=False, Adjust=False, Rebuild=0, Refit=0, Type="3")
weave = Weave(Pattern=[0, 1], Stream0=cull_index_2, Stream1=cull_index, NullGaps=False)
entwine = Entwine(Branch00=weave, Branch01=list_item_2, FlattenInputs=True)  # -> flatten(Result)
loft = Loft(Curves=entwine, Options=loft_options)
deconstruct_brep = DeconstructBrep(Brep=loft)  # -> Faces, Edges, Vertices
point_on_curve = PointOnCurve(entwine, parameter=0.5)
polyline = PolyLine(Vertices=point_on_curve, Closed=False)
explode = Explode(Curve=polyline, Recursive=True)  # -> Segments, Vertices
divide_distance = DivideDistance(Curve=explode.Segments, Distance=Slider(3.18, range=1..5))  # -> Points, Tangents, Parameters
list_length_3 = ListLength(List=divide_distance.Points)  # -> flatten(Length)
divide_surface = DivideSurface(Surface=deconstruct_brep.Faces, UCount=list_length_3, VCount=Slider(49, range=10..100))  # -> simplify(Points), Normals, Parameters
split_tree = SplitTree(Data=divide_surface.Points, Masks=flatten("{0;0}"))  # -> Positive, Negative
split_tree_2 = SplitTree(Data=divide_surface.Points, Masks=flatten("{0;0}"))  # -> Positive, Negative
negative_2 = Negative(Value="1")
shift_list = ShiftList(List=split_tree_2.Negative, Shift="1", Wrap=True)
shift_list_2 = ShiftList(List=split_tree.Negative, Shift=negative_2, Wrap=True)
line = Line(StartPoint=divide_surface.Points, EndPoint=shift_list)
line_2 = Line(StartPoint=divide_surface.Points, EndPoint=shift_list_2)
number_slider_3 = Slider(0.2, range=0..2)
merge_2 = Merge(Data1=line, Data2=line_2)
pipe = Pipe(Curve=[merge_2, circle_2], Radius=number_slider_3, Caps=0)

list_item_3 = ListItem(List=circle, Index=Slider(1, range=0..5), Wrap=True)
area = Area(Geometry=list_item_3)  # -> Area, Centroid
deconstruct = Deconstruct(Point=area.Centroid)  # -> XComponent, YComponent, ZComponent

# ----
# Presents
number_slider_4 = Slider(75, range=75..100)
subtraction = Subtraction(A=number_slider_4, B=10)
circle_3 = Circle(Plane=PlaneXY(0, 0, 0), Radius=number_slider_4)
circle_4 = Circle(Plane=PlaneXY(0, 0, 0), Radius=Slider(10, range=10..50))
circle_5 = Circle(Plane=PlaneXY(0, 0, 0), Radius=subtraction)
multiplication_3 = Multiplication(A=subtraction, B=2)
unit_z_2 = UnitZ(Factor=deconstruct.ZComponent)
point_on_curve_2 = PointOnCurve(list_item_3, parameter=0.25)
point_on_curve_3 = PointOnCurve(list_item_3, parameter=0.5)
point_on_curve_4 = PointOnCurve(list_item_3, parameter=0.75)
point_on_curve_5 = PointOnCurve(list_item_3, parameter=1)
extrude = Extrude(Base=circle_4, Direction=unit_z_2)
unit_z_3 = UnitZ(Factor="5")
rectangle = Rectangle(Plane=PlaneXY(0, 0, 0), XSize=multiplication_3, YSize=multiplication_3, Radius=0)  # -> Rectangle, Length
merge_3 = Merge(Data1=point_on_curve_2, Data2=point_on_curve_3, Data3=point_on_curve_4, Data4=point_on_curve_5)
surface = Surface(circle_3)
negative_3 = Negative(Value=unit_z_3)
line_3 = Line(StartPoint=area.Centroid, EndPoint=merge_3)
area_2 = Area(Geometry=rectangle.Rectangle)  # -> Area, Centroid
area_3 = Area(Geometry=circle_3)  # -> Area, Centroid
extrude_2 = Extrude(Base=circle_5, Direction=[unit_z_3, negative_3])
move_to_point = MoveToPoint(Geometry=rectangle.Rectangle, PointA=area_2.Centroid, PointB=area_3.Centroid)  # -> Moved, Vector, Transform
brep_join = BrepJoin(Breps=extrude_2)  # -> Breps, Closed
cap_holes = CapHoles(Brep=brep_join.Breps)
populate_2d = Populate2D(Region=move_to_point.Moved, Count=present_count, Seed=1)
point_in_brep = PointInBrep(Brep=cap_holes, Point=populate_2d, Strict=False)
construct_domain_3 = ConstructDomain(DomainStart=Slider(7, range=5..15), DomainEnd=Slider(21, range=5..25))
construct_domain_4 = ConstructDomain(DomainStart="1", DomainEnd="50")
member_index = MemberIndex(Set=point_in_brep, Member=Toggle(True))  # -> Index, Count
list_item_4 = ListItem(List=populate_2d, Index=member_index.Index, Wrap=True)
random_2 = Random(Range=construct_domain_4, Number="2", Seed=2)
list_length_4 = ListLength(List=list_item_4)
dispatch = Dispatch(List=random_2, DispatchPattern=[True, False])  # -> ListA, ListB
integer_2 = Integer(dispatch.ListA)
integer_3 = Integer(dispatch.ListB)
random_3 = Random(Range=construct_domain_3, Number=list_length_4, Seed=integer_2)
random_4 = Random(Range=construct_domain_3, Number=list_length_4, Seed=integer_3)
construct_domain_5 = ConstructDomain(DomainStart=Slider(5, range=5..15), DomainEnd=Slider(20, range=5..25))
rectangle_2 = Rectangle(Plane=list_item_4, XSize=random_3, YSize=random_4, Radius=0)  # -> Rectangle, Length
area_4 = Area(Geometry=rectangle_2.Rectangle)  # -> Area, Centroid
random_5 = Random(Range=construct_domain_5, Number=list_length_4, Seed=present_height_seed)
move_to_point_2 = MoveToPoint(Geometry=rectangle_2.Rectangle, PointA=area_4.Centroid, PointB=list_item_4)  # -> Moved, Vector, Transform
unit_z_4 = UnitZ(Factor=random_5)
extrude_3 = Extrude(Base=move_to_point_2.Moved, Direction=unit_z_4)
cap_holes_2 = CapHoles(Brep=extrude_3)
random_split_list = RandomSplitList(MasterList=cap_holes_2, Seed=2, Split=0.5)  # -> ListA, ListB
random_split_list_2 = RandomSplitList(MasterList=random_split_list.ListA, Seed=2, Split=0.5)  # -> ListA, ListB
random_split_list_3 = RandomSplitList(MasterList=random_split_list.ListB, Seed=2, Split=0.5)  # -> ListA, ListB

# ----
# Ribbon
list_length_5 = ListLength(List=deconstruct_brep.Faces)
expression_4 = Expression(x=list_length_5, Expression="x-1")
cull_index_3 = CullIndex(List=deconstruct_brep.Faces, Indices=expression_4, Wrap=True)
dispatch_2 = Dispatch(List=cull_index_3, DispatchPattern=[True, False])  # -> ListA, ListB
number_slider_5 = Slider(9, range=0..10)
negative_4 = Negative(Value=number_slider_5)
offset_on_srf = OffsetOnSrf(Curve=simplify(graft(cull_index)), Distance=number_slider_5, Surface=simplify(graft(dispatch_2.ListA)))  # -> simplify(Curve)
offset_on_srf_2 = OffsetOnSrf(Curve=simplify(cull_index), Distance=negative_4, Surface=simplify(dispatch_2.ListB))  # -> simplify(Curve)
surface_split = SurfaceSplit(Surface=simplify(graft(dispatch_2.ListB)), Curves=simplify(graft(offset_on_srf_2)))  # -> simplify(Fragments)
surface_split_2 = SurfaceSplit(Surface=simplify(graft(dispatch_2.ListA)), Curves=simplify(graft(offset_on_srf)))  # -> simplify(Fragments)
list_item_5 = ListItem(List=surface_split_2, Index="1", Wrap=True)
list_item_6 = ListItem(List=surface_split, Index="0", Wrap=True)
negative_5 = Negative(Value=Slider(1, range=0..10))
offset_surface = OffsetSurface(Surface=[list_item_5, list_item_6], Distance=negative_5, BothSides=0, CreateSolid=True)  # -> flatten(Offset)
custom_preview = CustomPreview(Geometry=offset_surface, Material=ColourSwatch(SwatchColor=RGB(247, 52, 52)))

# ----
# Star (Doesnt work)
xz_plane = XZPlane(Origin=list_item_2)  # disabled
number_slider_6 = Slider(125, range=0..360)  # disabled
number_slider_7 = Slider(15, range=5..25)  # disabled
panel_4 = Panel("5")  # disabled
polygon = Polygon(Plane=xz_plane, Radius=number_slider_7, Segments=panel_4, FilletRadius=0)  # -> Polygon, Length; disabled
radians = Radians(Degrees=number_slider_6)  # disabled
rotate = Rotate(Geometry=polygon.Polygon, Angle=radians, Plane=xz_plane)  # -> Geometry, Transform; disabled
unit_z_5 = UnitZ(Factor=number_slider_7)  # disabled
move_2 = Move(Geometry=rotate.Geometry, Motion=unit_z_5)  # -> Geometry, Transform; disabled
explode_2 = Explode(Curve=move_2.Geometry, Recursive=True)  # -> Segments, Vertices; disabled
explode_3 = Explode(Curve=explode_2.Segments, Recursive=True)  # -> Segments, Vertices; disabled
number_slider_8 = Slider(3, range=1..5)  # disabled
average = Average(Input=explode_3.Vertices)  # disabled
area_5 = Area(Geometry=move_2.Geometry)  # -> Area, Centroid; disabled
line_4 = Line(StartPoint=area_5.Centroid, EndPoint=explode_2.Vertices)  # disabled
unit_y = UnitY(Factor=number_slider_8)  # disabled
point_on_curve_6 = PointOnCurve(line_4, parameter=0.348)  # disabled
move_3 = Move(Geometry=area_5.Centroid, Motion=unit_y)  # -> Geometry, Transform; disabled
shift_list_3 = ShiftList(List=point_on_curve_6, Shift=1, Wrap=True)  # disabled
line_5 = Line(StartPoint=simplify(average), EndPoint=simplify(graft(point_on_curve_6)))  # disabled
line_6 = Line(StartPoint=simplify(average), EndPoint=simplify(graft(shift_list_3)))  # disabled
line_7 = Line(StartPoint=move_3.Geometry, EndPoint=average)  # -> simplify(Line); disabled
line_8 = Line(StartPoint=move_3.Geometry, EndPoint=point_on_curve_6)  # -> simplify(graft(Line)); disabled
merge_4 = Merge(Data1=line_7, Data2=line_5, Data3=line_8)  # disabled

area_6 = Area(Geometry=list_item)  # -> Area, Centroid
# Star (Import)
geometry = Geometry([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])
list_item_7 = ListItem(List=geometry, Index=0, Wrap=True)
deconstruct_brep_2 = DeconstructBrep(Brep=list_item_7)  # -> Faces, Edges, Vertices
list_item_8 = ListItem(List=deconstruct_brep_2.Edges, Index=Slider(3, range=0..3), Wrap=True)
area_7 = Area(Geometry=list_item_8)  # -> Area, Centroid
move_to_point_3 = MoveToPoint(Geometry=geometry, PointA=area_7.Centroid, PointB=area_6.Centroid)  # -> Moved, Vector, Transform
custom_preview_2 = CustomPreview(Geometry=move_to_point_3.Moved, Material=ColourSwatch(SwatchColor=RGB(255, 225, 0)))

data = Data(line_3)
data_2 = Data(extrude)
pipe_2 = Pipe(Curve=data, Radius=expr("x*2", number_slider_3), Caps=0)

custom_preview_3 = CustomPreview(Geometry=random_split_list_2.ListB, Material=ColourSwatch(SwatchColor=RGB(252, 122, 23)))
custom_preview_4 = CustomPreview(Geometry=random_split_list_2.ListA, Material=ColourSwatch(SwatchColor=RGB(0, 255, 60)))
custom_preview_5 = CustomPreview(Geometry=random_split_list_3.ListA, Material=ColourSwatch(SwatchColor=RGB(225, 255, 0)))
custom_preview_6 = CustomPreview(Geometry=random_split_list_3.ListB, Material=ColourSwatch(SwatchColor=RGB(174, 0, 255)))

custom_preview_7 = CustomPreview(Geometry=surface, Material=ColourSwatch(SwatchColor=RGB(240, 0, 0)))
custom_preview_8 = CustomPreview(Geometry=data_2, Material=ColourSwatch(SwatchColor=RGB(178, 92, 0)))

custom_preview_9 = CustomPreview(Geometry=[pipe, pipe_2], Material=ColourSwatch(SwatchColor=RGB(255, 255, 255)))
