# Grasshopper definition 002_ObjectPlacer.gh (Grasshopper 1.0.7)
# plug-ins: Kangaroo2 Components, Pufferfish

# ----
# Surface
number_slider = Slider(512, range=0..2000)
construct_point = ConstructPoint(XCoordinate=0, YCoordinate=number_slider, ZCoordinate=0)
line = Line(StartPoint="0,0,0", EndPoint=construct_point)
unit_x = UnitX(Factor=Slider(584, range=0..2000))
number_slider_2 = Slider(9, range=0..20)
move = Move(Geometry=line, Motion=unit_x)  # -> Geometry, Transform
number_slider_3 = Slider(10, range=0..20)
range = Range(Domain=Domain(0, 1), Steps=number_slider_2)
range_2 = Range(Domain=Domain(0, 1), Steps=number_slider_3)
divide_curve = DivideCurve(Curve=line, Count=number_slider_2, Kinks=False)  # -> Points, Tangents, Parameters
graph_mapper = GraphMapper(range, x0=0, x1=1, y0=0, y1=1, container_name="Sine", Equation_px=[0, 0.3295711279], Equation_py=[0, 1])
divide_curve_2 = DivideCurve(Curve=move.Geometry, Count=number_slider_3, Kinks=False)  # -> Points, Tangents, Parameters
graph_mapper_2 = GraphMapper(range_2, x0=0, x1=1, y0=0, y1=1, container_name="Sine", Equation_px=[0, 0.2238501012], Equation_py=[0, 0.9664032459])
construct_domain = ConstructDomain(DomainStart=Slider(47, range=0..200), DomainEnd=Slider(136, range=0..200))
construct_domain_2 = ConstructDomain(DomainStart=Slider(47, range=0..200), DomainEnd=Slider(101, range=0..200))
deconstruct = Deconstruct(Point=divide_curve.Points)  # -> XComponent, YComponent, ZComponent
deconstruct_2 = Deconstruct(Point=divide_curve_2.Points)  # -> XComponent, YComponent, ZComponent
remap_numbers = RemapNumbers(Value=graph_mapper, Source=Domain(0, 1), Target=construct_domain)  # -> Mapped, Clipped
remap_numbers_2 = RemapNumbers(Value=graph_mapper_2, Source=Domain(0, 1), Target=construct_domain_2)  # -> Mapped, Clipped
construct_point_2 = ConstructPoint(XCoordinate=0, YCoordinate=deconstruct.YComponent, ZCoordinate=remap_numbers.Mapped)
construct_point_3 = ConstructPoint(XCoordinate=deconstruct_2.XComponent, YCoordinate=deconstruct_2.YComponent, ZCoordinate=remap_numbers_2.Mapped)
interpolate = Interpolate(Vertices=construct_point_2, Degree=3, Periodic=False, KnotStyle=1)  # -> Curve, Length, Domain
interpolate_2 = Interpolate(Vertices=construct_point_3, Degree=3, Periodic=False, KnotStyle=1)  # -> Curve, Length, Domain
ruled_surface = RuledSurface(CurveA=interpolate.Curve, CurveB=interpolate_2.Curve)

# ----
# Object
number_slider_4 = Slider(33, range=0..100)
construct_point_4 = ConstructPoint(XCoordinate=0, YCoordinate=0, ZCoordinate=number_slider_4)
unit_z = UnitZ(Factor=Slider(19, range=0..20))
move_2 = Move(Geometry=construct_point_4, Motion=unit_z)  # -> Geometry, Transform
circle = Circle(Plane=move_2.Geometry, Radius=Slider(15, range=0..20))
divide_curve_3 = DivideCurve(Curve=circle, Count=Slider(3, range=0..10), Kinks=False)  # -> Points, Tangents, Parameters
line_2 = Line(StartPoint="0,0,0", EndPoint=construct_point_4)
line_3 = Line(StartPoint=construct_point_4, EndPoint=divide_curve_3.Points)
merge = Merge(Data1=line_2, Data2=line_3)
join_curves = JoinCurves(Curves=merge, Preserve=False)
multipipe = MultiPipe(
    Curves=join_curves,
    NodeSize=Slider(1.99, range=0..3),
    EndOffset=1,
    StrutSize=Slider(0.85, range=0..3),
    Segment=0,
    KinkAngle=0.6,
    CubeFit=0,
    Caps=Slider(1, range=0..3))

# ----
# You may connect
# your own surface!
surface = Surface(ruled_surface)

# ----
# You may connect
# your own object
geometry = Geometry(multipipe)

# ----
# Extrusion
project = Project(Geometry=surface, Plane=PlaneXY(0, 0, 0))  # -> Geometry, Transform
brep_edges = BrepEdges(Brep=project.Geometry)  # -> Naked, Interior, NonManifold
brep_edges_2 = BrepEdges(Brep=surface)  # -> Naked, Interior, NonManifold
ruled_surface_2 = RuledSurface(CurveA=brep_edges.Naked, CurveB=brep_edges_2.Naked)
brep_join = BrepJoin(Breps=ruled_surface_2)  # -> Breps, Closed

# ----
# Placer
number_slider_5 = Slider(23, range=1..100)
populate_geometry = PopulateGeometry(Geometry=surface, Count=number_slider_5, Seed=1)
surface_closest_point = SurfaceClosestPoint(Point=populate_geometry, Surface=surface)  # -> Point, UVPoint, Distance
evaluate_surface = EvaluateSurface(Surface=surface, Point=surface_closest_point.UVPoint)  # -> Point, Normal, UDirection, VDirection, Frame
construct_domain_3 = ConstructDomain(DomainStart=Slider(0.13, range=0..1), DomainEnd=Slider(0.59, range=0..1))
reverse = Reverse(Vector=evaluate_surface.Normal)
xy_plane = XYPlane(Origin=Point(0, 0, 0))
random = Random(Range="0 To 180", Number=number_slider_5, Seed=2)
radians = Radians(Degrees=random)

# ----
# Adjust the tilt strenght
random_2 = Random(Range=construct_domain_3, Number=number_slider_5, Seed=2)

tween_two_vectors = TweenTwoVectors(VectorA=xy_plane, VectorB=reverse, Factor=random_2)
plane_normal = PlaneNormal(Origin=populate_geometry, ZAxis=tween_two_vectors)
orient = Orient(Geometry=geometry, Source=PlaneXY(0, 0, 0), Target=plane_normal)  # -> Geometry, Transform
rotate = Rotate(Geometry=orient.Geometry, Angle=radians, Plane=plane_normal)  # -> Geometry, Transform

# ----
# Visualize the objects
colour_swatch = ColourSwatch(SwatchColor=RGB(163, 163, 163))
custom_preview = CustomPreview(Geometry=rotate.Geometry, Material=colour_swatch)
custom_preview_2 = CustomPreview(Geometry=[surface, brep_join.Breps], Material=ColourSwatch(SwatchColor=RGB(201, 125, 54)))
