# Grasshopper definition 003_WavingCurtain(wAnimator).gh (Grasshopper 1.0.7)

curtain_width = Slider(21, range=1..100)
curtain_height = Slider(25, range=1..100)
series = Series(Start=0, Step=Slider(10, range=1..100), Count=curtain_height)
series_2 = Series(Start=0, Step=Slider(40, range=1..100), Count=curtain_width)
construct_point = ConstructPoint(XCoordinate=simplify(graft(series_2)), YCoordinate=0, ZCoordinate=series)
deconstruct = Deconstruct(Point=construct_point)  # -> XComponent, YComponent, ZComponent

# ----
# Animation&Speed
trigger = Trigger(Interval=50, TimerInterval=50, Target=ghpython_script)  # disabled
speed = Slider(0.66, range=0.1..1)
ghpython_script = GhPythonScript(Reset=Button())  # -> out, a; inputs Reset: Boolean
# ---------- ghpython_script: Python ----------
__author__ = "burke"
__version__ = "2026.01.16"

if "count" not in globals() or Reset:
    count = 0
else:
    count += 1

a = count
# ---------- end ghpython_script ----------
multiplication = Multiplication(A=ghpython_script.a, B=speed)

bounds = Bounds(Numbers=deconstruct.ZComponent)
remap_numbers = RemapNumbers(Value=deconstruct.ZComponent, Source=bounds, Target=Domain(0, 1))  # -> Mapped, Clipped
multiplication_2 = Multiplication(A=deconstruct.XComponent, B=Slider(0.602, range=0.1..1))
graph_mapper = GraphMapper(
    remap_numbers.Mapped,
    x0=0,
    x1=1,
    y0=0,
    y1=1,
    container_name="Bezier",
    cpx=[0, 0.2804972231, 1, 1],
    cpy=[1, 0.3211840987, 0, 0])
addition = Addition(A=multiplication_2, B=multiplication)
graph_mapper_2 = GraphMapper(addition, x0=0, x1=1, y0=0, y1=1, container_name="Sine", Equation_px=[0, 0.3504134417], Equation_py=[0, 0.6781041622])
multiplication_3 = Multiplication(A=graph_mapper, B=Slider(77, range=1..100))
multiplication_4 = Multiplication(A=graph_mapper_2, B=multiplication_3)
construct_point_2 = ConstructPoint(XCoordinate=deconstruct.XComponent, YCoordinate=multiplication_4, ZCoordinate=deconstruct.ZComponent)  # -> simplify(Point)
surface_from_points = SurfaceFromPoints(Points=flatten(construct_point_2), UCount=curtain_width, Interpolate=False)
custom_preview = CustomPreview(Geometry=surface_from_points, Material=ColourSwatch(SwatchColor=RGB(217, 217, 217)))
