# Grasshopper definition 004_WavingCurtain(wAnimator)_V2.gh (Grasshopper 1.0.7)

# ----
# Parameters
fabricwrinkle = Slider(46, range=1..100)
curtain_width = Slider(20, range=1..100)
curtain_height = Slider(25, range=1..100)
fabricstiffness = Slider(0.736, range=0.1..2)
seed = Slider(0.54, range=0.1..1)

series = Series(Start=0, Step=Slider(10, range=1..100), Count=curtain_height)
series_2 = Series(Start=0, Step=Slider(40, range=1..100), Count=curtain_width)
construct_point = ConstructPoint(XCoordinate=simplify(graft(series_2)), YCoordinate=0, ZCoordinate=series)
deconstruct = Deconstruct(Point=construct_point)  # -> XComponent, YComponent, ZComponent

# ----
# Animation&Speed
trigger = Trigger(Interval=50, TimerInterval=50, Target=ghpython_script)  # disabled
speed = Slider(0.75, range=0.1..1)
ghpython_script = GhPythonScript(Reset=Button())  # -> out, a; inputs Reset: Boolean
# ---------- ghpython_script: Python ----------
__author__ = "burke"
__version__ = "2026.01.16"

if "count" not in globals() or Reset:
    count = 0
else:
    count += 1

a = count
# ---------- end ghpython_script ----------
multiplication = Multiplication(A=ghpython_script.a, B=speed)

data = Data(curtain_width)
bounds = Bounds(Numbers=deconstruct.ZComponent)
remap_numbers = RemapNumbers(Value=deconstruct.ZComponent, Source=bounds, Target=Domain(0, 1))  # -> Mapped, Clipped
multiplication_2 = Multiplication(A=deconstruct.XComponent, B=seed)
graph_mapper = GraphMapper(
    remap_numbers.Mapped,
    x0=0,
    x1=1,
    y0=0,
    y1=1,
    container_name="Bezier",
    cpx=[0, 0.2722227275, 1, 1],
    cpy=[1, 0.292086184, 0, 0])
addition = Addition(A=multiplication_2, B=multiplication)
graph_mapper_2 = GraphMapper(
    addition,
    x0=0,
    x1=1,
    y0=0,
    y1=1,
    container_name="Sine",
    Equation_px=[0, 0.4088267386],
    Equation_py=[0.1988868713, 0.7977705002])
multiplication_3 = Multiplication(A=graph_mapper, B=fabricwrinkle)
multiplication_4 = Multiplication(A=graph_mapper_2, B=multiplication_3)

# ----
# Billow Effect
data_2 = Data(multiplication_4)
absolute = Absolute(Value=data_2)
multiplication_5 = Multiplication(A=absolute, B=fabricstiffness)
addition_2 = Addition(A=deconstruct.ZComponent, B=multiplication_5)

construct_point_2 = ConstructPoint(XCoordinate=deconstruct.XComponent, YCoordinate=multiplication_4, ZCoordinate=addition_2)  # -> simplify(Point)
surface_from_points = SurfaceFromPoints(Points=flatten(construct_point_2), UCount=data, Interpolate=False)
custom_preview = CustomPreview(Geometry=surface_from_points, Material=ColourSwatch(SwatchColor=RGB(217, 217, 217)))
