# Grasshopper definition 005_AdaptiveSlider.gh (Grasshopper 1.0.7)
# plug-ins: MetaHopper

# ---- group: Max Value
number_slider = Slider(72, range=10..100)

# ----
# Note: Name of the
# slider should match
# the name in the panel!
panel = Panel("AdaptiveSlider")

# ----
# Adaptive Slider
adaptiveslider = Slider(45, range=0..71)

# ----
# C# Method
# (without any package)
series = Series(Start=0, Step=1, Count=number_slider)

# ----
# Connect your
# own data
list_length = ListLength(List=series)

expression = Expression(x=list_length, Expression="x-1")
c_script = CSharpScript(Name=panel, Max=expression)  # -> out, A; inputs Name: String, Max: Int32
# ---------- c_script: C# ----------
    // 1. Find the slider
    Grasshopper.Kernel.Special.GH_NumberSlider slider = null;
    
    foreach (var obj in this.GrasshopperDocument.Objects)
    {
      var s = obj as Grasshopper.Kernel.Special.GH_NumberSlider;
      if (s != null && s.NickName == Name)
      {
        slider = s;
        break;
      }
    }

    // 2. Check if slider exists and Update
    if (slider != null)
    {
      if (slider.Slider.Maximum != (decimal) Max)
      {
        this.GrasshopperDocument.ScheduleSolution(5, (Grasshopper.Kernel.GH_Document doc) => 
          {
          slider.Slider.Maximum = (decimal) Max;

          if (slider.Slider.Value > (decimal) Max)
            slider.Slider.Value = (decimal) Max;
                
          slider.ExpireSolution(false);
          });
      }
      // SUCCESS MESSAGE
      A = "Active: Controlling '" + Name + "'";
    }
    else
    {
      // FAILURE MESSAGE
      A = "Error: Slider '" + Name + "' not found."; 
    }
# ---------- end c_script ----------
panel_2 = Panel(c_script.A)

# ----
# Metahopper Method
# (with package)
panel_3 = Panel("AdaptiveSlider2")
get_object_by_nickname = GetObjectByNickname(NickName=panel_3)
set_slider_properties = SetSliderProperties(Slider=get_object_by_nickname, Range=expression)
adaptiveslider2 = Slider(65, range=0..71)
