# Grasshopper definition 006_CurveFitter.gh (Grasshopper 1.0.7)
# plug-ins: Bifocals

circle = Circle(Plane=PlaneXY(0, 0, 0), Radius=Slider(200, range=1..400))
number_slider = Slider(30, range=0..100)
divide_curve = DivideCurve(Curve=circle, Count=number_slider, Kinks=False)  # -> Points, Tangents, Parameters
deconstruct = Deconstruct(Point=divide_curve.Points)  # -> XComponent, YComponent, ZComponent
bounds = Bounds(Numbers=deconstruct.ZComponent)
construct_domain = ConstructDomain(DomainStart="0", DomainEnd=Slider(66, range=1..100))
remap_numbers = RemapNumbers(Value=deconstruct.ZComponent, Source=bounds, Target=Domain(0, 1))  # -> Mapped, Clipped
graph_mapper = GraphMapper(
    remap_numbers.Mapped,
    x0=0,
    x1=1,
    y0=0,
    y1=1,
    container_name="Bezier",
    cpx=[0, 0.8941491246, 0.2551178634, 1],
    cpy=[1, 0.94761163, 0, 0])
random = Random(Range=construct_domain, Number=number_slider, Seed=2)
multiplication = Multiplication(A=graph_mapper, B=random)
construct_point = ConstructPoint(XCoordinate=deconstruct.XComponent, YCoordinate=deconstruct.YComponent, ZCoordinate=multiplication)
interpolate = Interpolate(Vertices=construct_point, Degree=3, Periodic=Toggle(True), KnotStyle=1)  # -> Curve, Length, Domain
fit_curve = FitCurve(Curve=interpolate.Curve, Tolerance=Slider(0.06, range=0..1))

# ----
# Animation&Speed
trigger = Trigger(Interval=50, TimerInterval=50, Target=ghpython_script)  # disabled
ghpython_script = GhPythonScript(Reset=Button())  # -> out, a; inputs Reset: Boolean
# ---------- ghpython_script: Python ----------
__author__ = "burke"
__version__ = "2026.01.16"

if "count" not in globals() or Reset:
    count = 0
else:
    count += 1

a = count
# ---------- end ghpython_script ----------

control_points = ControlPoints(Curve=fit_curve)  # -> Points, Weights, Knots
curve_closest_point = CurveClosestPoint(Point=control_points.Points, Curve=fit_curve)  # -> Point, Parameter, Distance
interpolate_2 = Interpolate(Vertices=curve_closest_point.Point, Degree=3, Periodic=False, KnotStyle=1)  # -> Curve, Length, Domain
number_slider_2 = Slider(13, range=1..50)
list_item = ListItem(List=curve_closest_point.Point, Index=ghpython_script.a, Wrap=True)
sphere = Sphere(Base=list_item, Radius=number_slider_2)
unit_z = UnitZ(Factor=number_slider_2)
pipe = Pipe(Curve=interpolate_2.Curve, Radius=Slider(1, range=1..20), Caps=0)
move = Move(Geometry=sphere, Motion=unit_z)  # -> Geometry, Transform
custom_preview = CustomPreview(Geometry=pipe, Material=ColourSwatch(SwatchColor=RGB(255, 61, 61)))
custom_preview_2 = CustomPreview(Geometry=move.Geometry, Material=ColourSwatch(SwatchColor=RGB(41, 255, 144)))
