# Grasshopper definition 007_AdaptiveBrickFacade.gh (Grasshopper 1.0.7)
# plug-ins: Bifocals

number_slider = Slider(10, range=0..100)
series = Series(Start=0, Step=Slider(10, range=0..100), Count=Slider(50, range=0..100))
series_2 = Series(Start=0, Step=number_slider, Count=Slider(80, range=0..1000))
cross_reference = CrossReference(ListListA=series, ListListB=series_2, CrossMode=1)  # -> ListListA, ListListB
construct_point = ConstructPoint(XCoordinate=cross_reference.ListListA, YCoordinate=cross_reference.ListListB, ZCoordinate=0)
radians = Radians(Degrees="90")
yz_plane = YZPlane(Origin=Point(0, 0, 0))
rotate = Rotate(Geometry=construct_point, Angle=radians, Plane=yz_plane)  # -> Geometry, Transform
data = Data(number_slider)
xz_plane = XZPlane(Origin=rotate.Geometry)
unit_y = UnitY(Factor=data)
rectangle = Rectangle(Plane=xz_plane, XSize=data, YSize=data, Radius=0)  # -> Rectangle, Length
extrude = Extrude(Base=rectangle.Rectangle, Direction=unit_y)
cap_holes = CapHoles(Brep=extrude)
area = Area(Geometry=cap_holes)  # -> Area, Centroid
image_sampler = ImageSampler(
    construct_point,
    FilePath="C:\Users\atabe\OneDrive\Masaüstü\images.jpg",
    Filter="Value",
    Interpolate=False,
    Umax=500,
    Umin=1,
    Vmax=800,
    Vmin=1,
    Wrap=1)
remap_numbers = RemapNumbers(Value=image_sampler, Source=Domain(0, 1), Target="0 To 90")  # -> Mapped, Clipped
xy_plane = XYPlane(Origin=area.Centroid)  # -> flatten(Plane)
radians_2 = Radians(Degrees=remap_numbers.Mapped)
rotate_2 = Rotate(Geometry=cap_holes, Angle=radians_2, Plane=xy_plane)  # -> Geometry, Transform
custom_preview = CustomPreview(Geometry=rotate_2.Geometry, Material=ColourSwatch(SwatchColor=RGB(176, 176, 48)))
