# Grasshopper definition 008_FloorGenerator.gh (Grasshopper 1.0.7)
# plug-ins: Bifocals

# ----
# Add
# Your
# Geometry
brep = Brep(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)

# ----
# Floor Generator
number_slider = Slider(4, range=0..20)
unit_z = UnitZ(Factor=1)
contour = Contour(Shape=brep, Point=Point(0, 0, 0), Direction=unit_z, Distance=number_slider)  # -> flatten(Contours)
data = Data(unit_z)
negative = Negative(Value=data)
offset_curve = OffsetCurve(Curve=contour, Distance=expr("-x", Slider(0.76, range=0.1..4)), Corners=1)
extrude = Extrude(Base=offset_curve, Direction=negative)
cap_holes = CapHoles(Brep=extrude)
create_material = CreateMaterial(
    Diffuse=ColourSwatch(SwatchColor=RGB(166, 166, 166)),
    Specular=RGB(255, 255, 255),
    Emission=RGB(0, 0, 0),
    Transparency=0,
    Shine=0)
custom_preview = CustomPreview(Geometry=cap_holes, Material=create_material)

md_slider = MDSlider(SliderMode=0, slider_value=Point(0.5, 0.5, 0.5), x_domain=Domain(0, 1), y_domain=Domain(0, 1), z_domain=Domain(0, 1))

# ----
# Additional
deconstruct_brep = DeconstructBrep(Brep=brep)  # -> Faces, Edges, Vertices
panel = Panel("""0
5
6
7""")
cull_index = CullIndex(List=deconstruct_brep.Faces, Indices=panel, Wrap=True)
dispatch = Dispatch(List=cull_index, DispatchPattern=[True, False])  # -> ListA, ListB
unit_x = UnitX(Factor=1)
unit_y = UnitY(Factor=1)
contour_2 = Contour(Shape=dispatch.ListA, Point=Point(0, 0, 0), Direction=unit_x, Distance=Slider(2, range=0..20))  # -> flatten(Contours)
contour_3 = Contour(Shape=dispatch.ListB, Point=Point(0, 0, 0), Direction=unit_y, Distance=Slider(2, range=0..20))  # -> flatten(Contours)
create_material_2 = CreateMaterial(
    Diffuse=ColourSwatch(SwatchColor=RGB(0, 246, 255)),
    Specular=RGB(255, 255, 255),
    Emission=RGB(0, 0, 0),
    Transparency=Slider(0.5, range=0.1..1),
    Shine=Slider(65, range=0..100))
create_material_3 = CreateMaterial(
    Diffuse=ColourSwatch(SwatchColor=RGB(194, 194, 194)),
    Specular=RGB(255, 255, 255),
    Emission=RGB(0, 0, 0),
    Transparency=0,
    Shine=0)
custom_preview_2 = CustomPreview(Geometry=deconstruct_brep.Faces, Material=create_material_2)

evaluate_surface = EvaluateSurface(Surface=[dispatch.ListA, dispatch.ListB], Point=md_slider)  # -> Point, Normal, UDirection, VDirection, Frame
list_length = ListLength(List=contour_2)  # -> expr("x/2", Length)
amplitude = Amplitude(Vector=evaluate_surface.Normal, Amplitude=Slider(1.5, range=0..2))
split_list = SplitList(List=amplitude, Index="2")  # -> ListA, ListB
dispatch_2 = Dispatch(List=split_list.ListA, DispatchPattern=[True, False])  # -> ListA, ListB
dispatch_3 = Dispatch(List=split_list.ListB, DispatchPattern=[True, False])  # -> ListA, ListB
split_list_2 = SplitList(List=contour_2, Index=list_length)  # -> ListA, ListB
split_list_3 = SplitList(List=contour_3, Index=list_length)  # -> ListA, ListB
extrude_2 = Extrude(Base=split_list_2.ListA, Direction=dispatch_2.ListA)
extrude_3 = Extrude(Base=split_list_2.ListB, Direction=dispatch_2.ListB)
extrude_4 = Extrude(Base=split_list_3.ListA, Direction=dispatch_3.ListA)
extrude_5 = Extrude(Base=split_list_3.ListB, Direction=dispatch_3.ListB)
merge = Merge(Data1=extrude_2, Data2=extrude_3, Data3=extrude_4, Data4=extrude_5)

custom_preview_3 = CustomPreview(Geometry=merge, Material=create_material_3)
