# Grasshopper definition 010_AdaptiveBrickFacade(RunningBondPattern).gh (Grasshopper 1.0.7)
# plug-ins: Bifocals

number_slider = Slider(10, range=0..100)
number_slider_2 = Slider(100, range=0..100)
number_slider_3 = Slider(10, range=0..100)
series = Series(Start=0, Step=number_slider, Count=number_slider_2)
series_2 = Series(Start=0, Step=number_slider_3, Count="2")
cross_reference = CrossReference(ListListA=series, ListListB=series_2, CrossMode=1)  # -> ListListA, ListListB
construct_point = ConstructPoint(XCoordinate=cross_reference.ListListA, YCoordinate=cross_reference.ListListB, ZCoordinate=0)
split_list = SplitList(List=construct_point, Index=number_slider_2)  # -> ListA, ListB
dispatch = Dispatch(List=split_list.ListA, DispatchPattern=[True, False])  # -> ListA, ListB
dispatch_2 = Dispatch(List=split_list.ListB, DispatchPattern=invert([True, False]))  # -> ListA, ListB
series_3 = Series(Start=0, Step=expr("x*2", number_slider), Count=Slider(50, range=0..100))
unit_y = UnitY(Factor=series_3)  # -> graft(UnitVector)
merge = Merge(Data1=dispatch.ListA, Data2=dispatch_2.ListA)
move = Move(Geometry=merge, Motion=unit_y)  # -> flatten(Geometry), Transform
radians = Radians(Degrees="90")
yz_plane = YZPlane(Origin=Point(0, 0, 0))
rotate = Rotate(Geometry=move.Geometry, Angle=radians, Plane=yz_plane)  # -> Geometry, Transform
data = Data(number_slider)
data_2 = Data(number_slider_3)
xz_plane = XZPlane(Origin=rotate.Geometry)
expression = Expression(x=data, Expression="x*2")
rectangle = Rectangle(Plane=xz_plane, XSize=expression, YSize=data_2, Radius=0)  # -> Rectangle, Length
unit_y_2 = UnitY(Factor=data_2)
extrude = Extrude(Base=rectangle.Rectangle, Direction=unit_y_2)
cap_holes = CapHoles(Brep=extrude)
area = Area(Geometry=cap_holes)  # -> Area, Centroid
bounding_box = BoundingBox(Content=area.Centroid, Plane=PlaneXY(0, 0, 0), UnionBox=True)  # -> Box, Box_2
deconstruct = Deconstruct(Point=area.Centroid)  # -> XComponent, YComponent, ZComponent
deconstruct_box = DeconstructBox(Box=bounding_box.Box)  # -> Plane, X, Y, Z
remap_numbers = RemapNumbers(Value=deconstruct.XComponent, Source=deconstruct_box.X, Target=Domain(0, 1))  # -> Mapped, Clipped
remap_numbers_2 = RemapNumbers(Value=deconstruct.ZComponent, Source=deconstruct_box.Z, Target=Domain(0, 1))  # -> Mapped, Clipped
construct_point_2 = ConstructPoint(XCoordinate=remap_numbers.Mapped, YCoordinate=remap_numbers_2.Mapped, ZCoordinate=0)
image_sampler = ImageSampler(construct_point_2, Filter="Value", Interpolate=False, Umax=1, Umin=0, Vmax=1, Vmin=0, Wrap=1)
remap_numbers_3 = RemapNumbers(Value=image_sampler, Source=Domain(0, 1), Target="0 To 90")  # -> Mapped, Clipped
xy_plane = XYPlane(Origin=area.Centroid)  # -> flatten(Plane)
radians_2 = Radians(Degrees=remap_numbers_3.Mapped)  # -> flatten(Radians)
rotate_2 = Rotate(Geometry=flatten(cap_holes), Angle=radians_2, Plane=xy_plane)  # -> Geometry, Transform
custom_preview = CustomPreview(Geometry=rotate_2.Geometry, Material=ColourSwatch(SwatchColor=RGB(178, 104, 104)))
