# Grasshopper definition 011_DistrictConstructor.gh (Grasshopper 1.0.7)
# plug-ins: Pufferfish, Bifocals

# ----
# Parameters
baserectangley = Slider(50, range=0..60)
minstreedwidth = Slider(1, range=0..10)
maxstreedwidth = Slider(4, range=0..40)
width = Slider(0, range=0..50)
treeheight = Slider(8, range=1..10)
tree_seed = Slider(4, range=0..50)
treebase = Slider(5, range=1..5)
baserectanglex = Slider(50, range=0..60)
length = Slider(0, range=0..50)
buildingshifterx_seed = Slider(0, range=0..50)
buildingshiftery_seed = Slider(0, range=0..50)
streetwidth_seed = Slider(3, range=0..50)
jitterx = Slider(0, range=0..50)
jittery = Slider(0, range=0..50)
buildingheightmin = Slider(5, range=0..50)
buildingheightmin_2 = Slider(20, range=0..50)
buildingheight_seed = Slider(13, range=0..50)

# ---- group: Base Array
xy = XYPlane(Origin=Point(0, 0, 0))
rectangle = Rectangle(Plane=xy, XSize=baserectanglex, YSize=baserectangley, Radius=0)  # -> Rectangle, Length
road_offset = Slider(2, range=0..10)
area = Area(Geometry=rectangle.Rectangle)  # -> Area, Centroid
division = Division(A=road_offset, B="2")
offset = OffsetCurve(Curve=rectangle.Rectangle, Distance=division, Plane=area.Centroid, Corners=1)
arrrec = RectangularArray(Geometry=rectangle.Rectangle, Cell=offset, XCount=Slider(3, range=0..10), YCount=Slider(3, range=0..10))  # -> Geometry, Transform
road_off_set = Slider(1, range=0..10)
neg = Negative(Value=road_off_set)
random_values = GhPythonScript(minimum=minstreedwidth, maximum=maxstreedwidth, amount="1", random_values=streetwidth_seed)  # -> simplify(flatten(out)), a
# ---------- random_values: Python ----------
__author__ = "atabe"
__version__ = "2023.08.15"

import rhinoscriptsyntax as rs
import random

min_value = minimum
max_value = maximum
random_state = random_values

random.seed(random_values)
num_of_values = int(amount)

random_values = [random.uniform(min_value, max_value) for _ in range(num_of_values)]

for value in random_values:
    print(int(value))
# ---------- end random_values ----------
neg_2 = Negative(Value=random_values.out)

# ----
area_2 = Area(Geometry=arrrec.Geometry)  # -> Area, Centroid

# ---- group: Base Array (continued)
offset_2 = OffsetCurve(Curve=arrrec.Geometry, Distance=neg, Plane=area_2.Centroid, Corners=1)  # -> flatten(Curve)

# ----
area_3 = Area(Geometry=offset_2)  # -> Area, Centroid

# ---- group: Base Array (continued)
offset_3 = OffsetCurve(Curve=offset_2, Distance=neg_2, Plane=area_3.Centroid, Corners=1)  # -> flatten(Curve)
dim = Dimensions(Surface=offset_3)  # -> UDimension, VDimension

# ---- group: Building Footprints
lng = ListLength(List=offset_3)
lng_2 = ListLength(List=offset_3)
num = Number(Slider(10, range=1..16))
num_2 = Number(Slider(50, range=0..100))
num_3 = Number(Slider(10, range=1..16))
num_4 = Number(Slider(50, range=0..100))
random_values_2 = GhPythonScript(minimum=num, maximum=num_2, amount=lng, random_state=width, standart_deviation=Slider(5, range=0..10))  # -> simplify(out), a
# ---------- random_values_2: Python ----------
__author__ = "burke"
__version__ = "2023.08.15"

import rhinoscriptsyntax as rs
import random

std_deviation = standart_deviation
min_value = minimum
max_value = maximum
mean = (max_value + min_value)/ 2

num_of_values = int(amount)

random.seed(random_state)

random_values = []
while len(random_values) < num_of_values:
    random_value = random.gauss(mean, std_deviation)
    if min_value <= random_value <= max_value:
        random_values.append(random_value)

for value in random_values:
    print(value)
# ---------- end random_values_2 ----------
random_values_3 = GhPythonScript(minimum=num_3, maximum=num_4, amount=lng_2, random_state=length, standart_deviation=Slider(3, range=0..10))  # -> simplify(out), a; same code as random_values_2
trim = TrimTree(Tree=random_values_2.out, Depth=1)
trim_2 = TrimTree(Tree=random_values_3.out, Depth=1)
roundd = RoundToDecimalPlace(NumberX=trim, DecimalPlace="1", RoundType=0)  # -> simplify(Rounded), Difference
roundd_2 = RoundToDecimalPlace(NumberX=trim_2, DecimalPlace="1", RoundType=0)  # -> simplify(Rounded), Difference
area_4 = Area(Geometry=offset_3)  # -> Area, Centroid
branch = TreeBranch(Tree=roundd_2.Rounded, Path="{0}", MaintainPaths=True)
rectangle_2 = Rectangle(Plane=area_4.Centroid, XSize=branch, YSize=roundd.Rounded, Radius=0)  # -> Rectangle, Length
area_5 = Area(Geometry=rectangle_2.Rectangle)  # -> Area, Centroid
move2pt = MoveToPoint(Geometry=rectangle_2.Rectangle, PointA=area_5.Centroid, PointB=area_4.Centroid)  # -> Moved, Vector, Transform

data = Data(dim.UDimension)
data_2 = Data(dim.VDimension)
dim_2 = Dimensions(Surface=move2pt.Moved)  # -> UDimension, VDimension
division_2 = Division(A=dim_2.UDimension, B=2)
division_3 = Division(A=data, B=2)
division_4 = Division(A=dim_2.VDimension, B=2)
division_5 = Division(A=data_2, B=2)
subtraction = Subtraction(A=division_3, B=division_2)
subtraction_2 = Subtraction(A=division_5, B=division_4)
python = GhPythonScript(x=subtraction)  # -> out, result
# ---------- python: Python ----------
__author__ = "burke"
__version__ = "2023.09.29"

import rhinoscriptsyntax as rs

if (x > 0):
    result = x
else:
    result = 0
    print(result)
# ---------- end python ----------
python_2 = GhPythonScript(x=subtraction_2)  # -> out, result; same code as python
neg_3 = Negative(Value=python.result)
neg_4 = Negative(Value=python_2.result)
random_values_4 = GhPythonScript(minimum=neg_3, maximum=python.result, amount="1", random_values=buildingshifterx_seed)  # -> simplify(flatten(out)), a
# ---------- random_values_4: Python ----------
__author__ = "burke"
__version__ = "2023.08.15"

import rhinoscriptsyntax as rs
import random

min_value = minimum
max_value = maximum
random_state = random_values

random.seed(random_values)
num_of_values = int(amount)

random_values = [random.uniform(min_value, max_value) for _ in range(num_of_values)]

for value in random_values:
    print(value)
# ---------- end random_values_4 ----------
random_values_5 = GhPythonScript(minimum=neg_4, maximum=python_2.result, amount="1", random_values=buildingshiftery_seed)  # -> simplify(flatten(out)), a; same code as random_values_4
python_3 = GhPythonScript(x=random_values_4.out, y=jitterx)  # -> flatten(out), a; inputs x: list
# ---------- python_3: Python ----------
__author__ = "burke"
__version__ = "2023.11.01"

import rhinoscriptsyntax as rs
import random


values = x 


def random_sign_change(value):
    value = float(value)  
    if value < 0:
        return abs(value) 
    elif value > 0:
        return -value 
    else:
        return value  


iteration = y
random.seed(iteration) 
num_to_change = random.randint(1, len(values)) 
indices_to_change = random.sample(range(len(values)), num_to_change) 

modified_values = []
for i, value in enumerate(values):
    if i in indices_to_change:
        modified_values.append(str(random_sign_change(value))) 
    else:
        modified_values.append(value)  


for value in modified_values:
    print(value)
# ---------- end python_3 ----------
python_4 = GhPythonScript(x=random_values_5.out, y=jittery)  # -> flatten(out), a; inputs x: list
# ---------- python_4: Python ----------
__author__ = "burke"
__version__ = "2023.11.01"

import rhinoscriptsyntax as rs
import random

values = x  

def random_sign_change(value):
    value = float(value)
    if value < 0:
        return abs(value)
    elif value > 0:
        return -value
    else:
        return value

iteration = y
random.seed(iteration)  
num_to_change = random.randint(1, len(values))
indices_to_change = random.sample(range(len(values)), num_to_change)

modified_values = []
for i, value in enumerate(values):
    if i in indices_to_change:
        modified_values.append(str(random_sign_change(value)))
    else:
        modified_values.append(value)

for value in modified_values:
    print(value)
# ---------- end python_4 ----------
roundd_3 = RoundToDecimalPlace(NumberX=python_3.out, DecimalPlace="2", RoundType=0)  # -> simplify(Rounded), Difference
roundd_4 = RoundToDecimalPlace(NumberX=python_4.out, DecimalPlace="2", RoundType=0)  # -> simplify(Rounded), Difference
vec = VectorXYZ(XComponent=roundd_3.Rounded, YComponent=roundd_4.Rounded, ZComponent=0)  # -> flatten(Vector), Length

# ---- group: BuildingExtrusion
move = Move(Geometry=move2pt.Moved, Motion=vec.Vector)  # -> Geometry, Transform
construct_domain = ConstructDomain(DomainStart=buildingheightmin, DomainEnd=buildingheightmin_2)
list_length = ListLength(List=move.Geometry)
random = Random(Range=construct_domain, Number=list_length, Seed=buildingheight_seed)
unit_z = UnitZ(Factor=random)
extrude = Extrude(Base=move.Geometry, Direction=unit_z)
cap_holes = CapHoles(Brep=extrude)

# ----
bounding_rectangle = BoundingRectangle(Geometry=offset_3, Plane=PlaneXY(0, 0, 0), Axis=0, Slide=0, Union=True)  # -> Bounding, DimensionX, DimensionY
surface = Surface(bounding_rectangle.Bounding)
surface_2 = Surface(offset_3)

# ---- group: Tree
unit_x = UnitX(Factor=1)
line_sdl = LineSDL(Start="0,0,0", Direction=unit_x, Length=treebase)
surface_3 = Surface(move.Geometry)
curve_middle = CurveMiddle(Curve=line_sdl)
solid_difference = SolidDifference(BrepsA=surface_2, BrepsB=surface_3)
end_points = EndPoints(Curve=line_sdl)  # -> Start, End
unit_z_2 = UnitZ(Factor=treeheight)
move_2 = Move(Geometry=curve_middle, Motion=unit_z_2)  # -> Geometry, Transform
populate_geometry = PopulateGeometry(Geometry=solid_difference, Count=Slider(10, range=5..30), Seed=1)
line = Line(StartPoint=end_points.Start, EndPoint=move_2.Geometry)
line_2 = Line(StartPoint=move_2.Geometry, EndPoint=end_points.End)
radians = Radians(Degrees="90")
join_curves = JoinCurves(Curves=[line, line_2, line_sdl], Preserve=False)
surface_4 = Surface(join_curves)
rotate = Rotate(Geometry=surface_4, Angle=radians, Plane=curve_middle)  # -> Geometry, Transform
construct_domain_2 = ConstructDomain(DomainStart=Slider(0.8, range=0.1..1), DomainEnd=Slider(1.4, range=0.1..2))
list_length_2 = ListLength(List=populate_geometry)
random_2 = Random(Range=construct_domain_2, Number=list_length_2, Seed=tree_seed)
mesh_join = MeshJoin(Meshes=[surface_4, rotate.Geometry])
scale_nu = ScaleNU(Geometry=mesh_join, Plane=curve_middle, ScaleX=random_2, ScaleY=random_2, ScaleZ=random_2)  # -> Geometry, Transform
move_to_point = MoveToPoint(Geometry=scale_nu.Geometry, PointA=curve_middle, PointB=populate_geometry)  # -> Moved, Vector, Transform

# ----
solid_difference_2 = SolidDifference(BrepsA=surface, BrepsB=surface_2)

# ---- group: Visualization / Street
create_material = CreateMaterial(
    Diffuse=ColourSwatch(SwatchColor=RGB(110, 110, 110)),
    Specular=RGB(255, 255, 255),
    Emission=RGB(0, 0, 0),
    Transparency=0,
    Shine=0)
custom_preview = CustomPreview(Geometry=solid_difference_2, Material=create_material)

# ---- group: Visualization / Plots
create_material_2 = CreateMaterial(
    Diffuse=ColourSwatch(SwatchColor=RGB(182, 217, 137)),
    Specular=RGB(255, 255, 255),
    Emission=RGB(0, 0, 0),
    Transparency=0,
    Shine=0)
custom_preview_2 = CustomPreview(Geometry=surface_2, Material=create_material_2)

create_material_3 = CreateMaterial(
    Diffuse=ColourSwatch(SwatchColor=RGB(217, 184, 184)),
    Specular=RGB(255, 255, 255),
    Emission=RGB(0, 0, 0),
    Transparency=0,
    Shine=0)
custom_preview_3 = CustomPreview(Geometry=cap_holes, Material=create_material_3)

# ---- group: Visualization / Trees
create_material_4 = CreateMaterial(
    Diffuse=ColourSwatch(SwatchColor=RGB(77, 135, 0)),
    Specular=RGB(255, 255, 255),
    Emission=RGB(0, 0, 0),
    Transparency=0,
    Shine=0)
custom_preview_4 = CustomPreview(Geometry=move_to_point.Moved, Material=create_material_4)
