# Grasshopper definition 012_HipRoofGenerator.gh (Grasshopper 1.0.7)
# plug-ins: Pufferfish, Bifocals

# ----
# Roof Parameters
roofheight = Slider(6, range=1..10)
roofoffset = Slider(2, range=1..5)

buildingshifterx_seed = Slider(1, range=0..50)

# ---- group: Base Array
xy = XYPlane(Origin=Point(0, 0, 0))
baserectanglex = Slider(50, range=0..60)
baserectangley = Slider(50, range=0..60)
rectangle = Rectangle(Plane=xy, XSize=baserectanglex, YSize=baserectangley, Radius=0)  # -> Rectangle, Length
road_offset = Slider(2, range=0..10)
area = Area(Geometry=rectangle.Rectangle)  # -> Area, Centroid
division = Division(A=road_offset, B="2")
offset = OffsetCurve(Curve=rectangle.Rectangle, Distance=division, Plane=area.Centroid, Corners=1)
arrrec = RectangularArray(Geometry=rectangle.Rectangle, Cell=offset, XCount=Slider(6, range=0..10), YCount=Slider(3, range=0..10))  # -> Geometry, Transform
road_off_set = Slider(1, range=0..10)
minstreedwidth = Slider(1, range=0..10)
maxstreedwidth = Slider(4, range=0..40)
streetwidth_seed = Slider(0, range=0..50)
neg = Negative(Value=road_off_set)
random_values = GhPythonScript(minimum=minstreedwidth, maximum=maxstreedwidth, amount="1", random_values=streetwidth_seed)  # -> simplify(flatten(out)), a
# ---------- random_values: Python ----------
__author__ = "atabe"
__version__ = "2023.08.15"

import rhinoscriptsyntax as rs
import random

min_value = minimum
max_value = maximum
random_state = random_values

random.seed(random_values)
num_of_values = int(amount)

random_values = [random.uniform(min_value, max_value) for _ in range(num_of_values)]

for value in random_values:
    print(int(value))
# ---------- end random_values ----------
neg_2 = Negative(Value=random_values.out)

# ----
area_2 = Area(Geometry=arrrec.Geometry)  # -> Area, Centroid

# ---- group: Base Array (continued)
offset_2 = OffsetCurve(Curve=arrrec.Geometry, Distance=neg, Plane=area_2.Centroid, Corners=1)  # -> flatten(Curve)

# ----
area_3 = Area(Geometry=offset_2)  # -> Area, Centroid

# ---- group: Base Array (continued)
offset_3 = OffsetCurve(Curve=offset_2, Distance=neg_2, Plane=area_3.Centroid, Corners=1)  # -> flatten(Curve)
dim = Dimensions(Surface=offset_3)  # -> UDimension, VDimension

# ---- group: Building Footprints
lng = ListLength(List=offset_3)
width = Slider(0, range=0..50)
lng_2 = ListLength(List=offset_3)
length = Slider(0, range=0..50)
num = Number(Slider(10, range=1..16))
num_2 = Number(Slider(50, range=0..100))
num_3 = Number(Slider(50, range=0..100))
num_4 = Number(Slider(10, range=1..16))
random_values_2 = GhPythonScript(minimum=num, maximum=num_2, amount=lng, random_state=width, standart_deviation=Slider(5, range=0..10))  # -> simplify(out), a
# ---------- random_values_2: Python ----------
__author__ = "burke"
__version__ = "2023.08.15"

import rhinoscriptsyntax as rs
import random

std_deviation = standart_deviation
min_value = minimum
max_value = maximum
mean = (max_value + min_value)/ 2

num_of_values = int(amount)

random.seed(random_state)

random_values = []
while len(random_values) < num_of_values:
    random_value = random.gauss(mean, std_deviation)
    if min_value <= random_value <= max_value:
        random_values.append(random_value)

for value in random_values:
    print(value)
# ---------- end random_values_2 ----------
random_values_3 = GhPythonScript(minimum=num_4, maximum=num_3, amount=lng_2, random_state=length, standart_deviation=Slider(3, range=0..10))  # -> simplify(out), a; same code as random_values_2
trim = TrimTree(Tree=random_values_3.out, Depth=1)
trim_2 = TrimTree(Tree=random_values_2.out, Depth=1)
roundd = RoundToDecimalPlace(NumberX=trim_2, DecimalPlace="1", RoundType=0)  # -> simplify(Rounded), Difference
roundd_2 = RoundToDecimalPlace(NumberX=trim, DecimalPlace="1", RoundType=0)  # -> simplify(Rounded), Difference
area_4 = Area(Geometry=offset_3)  # -> Area, Centroid
branch = TreeBranch(Tree=roundd_2.Rounded, Path="{0}", MaintainPaths=True)
rectangle_2 = Rectangle(Plane=area_4.Centroid, XSize=branch, YSize=roundd.Rounded, Radius=0)  # -> Rectangle, Length
area_5 = Area(Geometry=rectangle_2.Rectangle)  # -> Area, Centroid
move2pt = MoveToPoint(Geometry=rectangle_2.Rectangle, PointA=area_5.Centroid, PointB=area_4.Centroid)  # -> Moved, Vector, Transform

data = Data(dim.UDimension)
data_2 = Data(dim.VDimension)
dim_2 = Dimensions(Surface=move2pt.Moved)  # -> UDimension, VDimension
division_2 = Division(A=dim_2.UDimension, B=2)
division_3 = Division(A=data, B=2)
division_4 = Division(A=dim_2.VDimension, B=2)
division_5 = Division(A=data_2, B=2)
subtraction = Subtraction(A=division_3, B=division_2)
subtraction_2 = Subtraction(A=division_5, B=division_4)
python = GhPythonScript(x=subtraction_2)  # -> out, result
# ---------- python: Python ----------
__author__ = "burke"
__version__ = "2023.09.29"

import rhinoscriptsyntax as rs

if (x > 0):
    result = x
else:
    result = 0
    print(result)
# ---------- end python ----------
python_2 = GhPythonScript(x=subtraction)  # -> out, result; same code as python
buildingshiftery_seed = Slider(1, range=0..50)
neg_3 = Negative(Value=python.result)
neg_4 = Negative(Value=python_2.result)
jitterx = Slider(0, range=0..50)
jittery = Slider(0, range=0..50)
random_values_4 = GhPythonScript(minimum=neg_4, maximum=python_2.result, amount="1", random_values=buildingshifterx_seed)  # -> simplify(flatten(out)), a
# ---------- random_values_4: Python ----------
__author__ = "burke"
__version__ = "2023.08.15"

import rhinoscriptsyntax as rs
import random

min_value = minimum
max_value = maximum
random_state = random_values

random.seed(random_values)
num_of_values = int(amount)

random_values = [random.uniform(min_value, max_value) for _ in range(num_of_values)]

for value in random_values:
    print(value)
# ---------- end random_values_4 ----------
random_values_5 = GhPythonScript(minimum=neg_3, maximum=python.result, amount="1", random_values=buildingshiftery_seed)  # -> simplify(flatten(out)), a; same code as random_values_4
python_3 = GhPythonScript(x=random_values_4.out, y=jitterx)  # -> flatten(out), a; inputs x: list
# ---------- python_3: Python ----------
__author__ = "burke"
__version__ = "2023.11.01"

import rhinoscriptsyntax as rs
import random


values = x 


def random_sign_change(value):
    value = float(value)  
    if value < 0:
        return abs(value) 
    elif value > 0:
        return -value 
    else:
        return value  


iteration = y
random.seed(iteration) 
num_to_change = random.randint(1, len(values)) 
indices_to_change = random.sample(range(len(values)), num_to_change) 

modified_values = []
for i, value in enumerate(values):
    if i in indices_to_change:
        modified_values.append(str(random_sign_change(value))) 
    else:
        modified_values.append(value)  


for value in modified_values:
    print(value)
# ---------- end python_3 ----------
python_4 = GhPythonScript(x=random_values_5.out, y=jittery)  # -> flatten(out), a; inputs x: list
# ---------- python_4: Python ----------
__author__ = "burke"
__version__ = "2023.11.01"

import rhinoscriptsyntax as rs
import random

values = x  

def random_sign_change(value):
    value = float(value)
    if value < 0:
        return abs(value)
    elif value > 0:
        return -value
    else:
        return value

iteration = y
random.seed(iteration)  
num_to_change = random.randint(1, len(values))
indices_to_change = random.sample(range(len(values)), num_to_change)

modified_values = []
for i, value in enumerate(values):
    if i in indices_to_change:
        modified_values.append(str(random_sign_change(value)))
    else:
        modified_values.append(value)

for value in modified_values:
    print(value)
# ---------- end python_4 ----------
roundd_3 = RoundToDecimalPlace(NumberX=python_3.out, DecimalPlace="2", RoundType=0)  # -> simplify(Rounded), Difference
roundd_4 = RoundToDecimalPlace(NumberX=python_4.out, DecimalPlace="2", RoundType=0)  # -> simplify(Rounded), Difference
vec = VectorXYZ(XComponent=roundd_3.Rounded, YComponent=roundd_4.Rounded, ZComponent=0)  # -> flatten(Vector), Length

# ---- group: BuildingExtrusion
move = Move(Geometry=move2pt.Moved, Motion=vec.Vector)  # -> Geometry, Transform
buildingheightmax = Slider(20, range=0..50)
buildingheightmin = Slider(5, range=0..50)
construct_domain = ConstructDomain(DomainStart=buildingheightmin, DomainEnd=buildingheightmax)
buildingheight_seed = Slider(18, range=0..50)
list_length = ListLength(List=move.Geometry)
random = Random(Range=construct_domain, Number=list_length, Seed=buildingheight_seed)
unit_z = UnitZ(Factor=random)
extrude = Extrude(Base=move.Geometry, Direction=unit_z)
cap_holes = CapHoles(Brep=extrude)

# ---- group: RoofGenerator
unit_z_2 = UnitZ(Factor=random)
move_2 = Move(Geometry=move.Geometry, Motion=unit_z_2)  # -> Geometry, Transform
offset_curve = OffsetCurve(Curve=move_2.Geometry, Distance=roofoffset, Corners=1)
explode = Explode(Curve=offset_curve, Recursive=True)  # -> simplify(Segments), Vertices
area_6 = Area(Geometry=offset_curve)  # -> Area, Centroid
unit_z_3 = UnitZ(Factor=roofheight)
move_3 = Move(Geometry=area_6.Centroid, Motion=unit_z_3)  # -> Geometry, Transform
length_2 = Length(Curve=explode.Segments)
sort_list = SortList(Keys=length_2, ValuesA=explode.Segments)  # -> reverse(Keys), ValuesA
panel = Panel("""0
2""")
list_item = ListItem(List=sort_list.ValuesA, Index=panel, Wrap=True)
dispatch = Dispatch(List=list_item, DispatchPattern=[True, False])  # -> ListA, ListB
length_3 = Length(Curve=dispatch.ListA)
length_4 = Length(Curve=dispatch.ListB)
end_points = EndPoints(Curve=dispatch.ListB)  # -> Start, End
subtraction_3 = Subtraction(A=length_3, B=length_4)
vector_2pt = Vector2Pt(PointA=end_points.Start, PointB=end_points.End, Unitize=False)  # -> Vector, Length
line_sdl = LineSDL(Start=end_points.End, Direction=vector_2pt.Vector, Length=subtraction_3)
curve_middle = CurveMiddle(Curve=line_sdl)
move_to_point = MoveToPoint(Geometry=line_sdl, PointA=curve_middle, PointB=graft(move_3.Geometry))  # -> simplify(Moved), Vector, Transform
curve = Curve(dispatch.ListA)
curve_2 = Curve(dispatch.ListB)
end_points_2 = EndPoints(Curve=move_to_point.Moved)  # -> Start, End
end_points_3 = EndPoints(Curve=curve)  # -> Start, End
end_points_4 = EndPoints(Curve=curve_2)  # -> Start, End
line = Line(StartPoint=end_points_2.End, EndPoint=end_points_3.Start)
line_2 = Line(StartPoint=end_points_2.End, EndPoint=end_points_3.End)
line_3 = Line(StartPoint=end_points_4.End, EndPoint=end_points_2.Start)
merge = Merge(Data1=line, Data2=line_2, Data3=curve)
merge_2 = Merge(Data1=line_2, Data2=move_to_point.Moved, Data3=line_3, Data4=curve_2)
boundary_surfaces = BoundarySurfaces(Edges=[merge, merge_2])
xy_plane = XYPlane(Origin=area_6.Centroid)
rotate = Rotate(Geometry=boundary_surfaces, Angle=degrees("180"), Plane=graft(xy_plane))  # -> Geometry, Transform
brep_join = BrepJoin(Breps=[rotate.Geometry, boundary_surfaces])  # -> Breps, Closed

# ---- group: Roads
bounding_rectangle = BoundingRectangle(Geometry=offset_3, Plane=PlaneXY(0, 0, 0), Axis=0, Slide=0, Union=True)  # -> Bounding, DimensionX, DimensionY
surface = Surface(bounding_rectangle.Bounding)
surface_2 = Surface(offset_3)
solid_difference = SolidDifference(BrepsA=surface, BrepsB=surface_2)

# ---- group: Street
create_material = CreateMaterial(
    Diffuse=ColourSwatch(SwatchColor=RGB(110, 110, 110)),
    Specular=RGB(255, 255, 255),
    Emission=RGB(0, 0, 0),
    Transparency=0,
    Shine=0)
custom_preview = CustomPreview(Geometry=solid_difference, Material=create_material)

# ---- group: Plots
create_material_2 = CreateMaterial(
    Diffuse=ColourSwatch(SwatchColor=RGB(182, 217, 137)),
    Specular=RGB(255, 255, 255),
    Emission=RGB(0, 0, 0),
    Transparency=0,
    Shine=0)
custom_preview_2 = CustomPreview(Geometry=surface_2, Material=create_material_2)

create_material_3 = CreateMaterial(
    Diffuse=ColourSwatch(SwatchColor=RGB(217, 184, 184)),
    Specular=RGB(255, 255, 255),
    Emission=RGB(0, 0, 0),
    Transparency=0,
    Shine=0)
custom_preview_3 = CustomPreview(Geometry=cap_holes, Material=create_material_3)

create_material_4 = CreateMaterial(
    Diffuse=ColourSwatch(SwatchColor=RGB(217, 134, 102)),
    Specular=RGB(255, 255, 255),
    Emission=RGB(0, 0, 0),
    Transparency=0,
    Shine=0)
custom_preview_4 = CustomPreview(Geometry=brep_join.Breps, Material=create_material_4)
