# Grasshopper definition 013_ChainlinkFence.gh (Grasshopper 1.0.7)
# plug-ins: Bifocals

# ----
# Parameters
fence_height = Slider(100, range=10..100)
baluster_radius = Slider(1.5, range=1..3)
fence_lenght = Slider(5, range=1..10)
piperadius = Slider(0.1, range=0.1..1)

# ----
# Chain Link
number_slider = Slider(100, range=0..100)
multiplication = Multiplication(A=fence_lenght, B=number_slider)
unit_x = UnitX(Factor=1)
line_sdl = LineSDL(Start="0,0,0", Direction=unit_x, Length=multiplication)
number_slider_2 = Slider(5, range=1..10)
divide_distance = DivideDistance(Curve=line_sdl, Distance=number_slider_2)  # -> Points, Tangents, Parameters
# Balusters
unit_z = UnitZ(Factor=fence_height)
move = Move(Geometry=divide_distance.Points, Motion=unit_z)  # -> Geometry, Transform
line = Line(StartPoint=divide_distance.Points, EndPoint=move.Geometry)
divide_curve = DivideCurve(Curve=line, Count=Slider(22, range=0..100), Kinks=False)  # -> Points, Tangents, Parameters
dispatch = Dispatch(List=divide_curve.Points, DispatchPattern=[True, False])  # -> ListA, ListB
division = Division(A=number_slider_2, B="2")
addition = Addition(A=division, B=Slider(1, range=0.1..1))
unit_x_2 = UnitX(Factor=addition)
unit_x_3 = UnitX(Factor=division)
negative = Negative(Value=unit_x_3)
move_2 = Move(Geometry=dispatch.ListB, Motion=unit_x_2)  # -> Geometry, Transform
move_3 = Move(Geometry=dispatch.ListB, Motion=negative)  # -> Geometry, Transform
cull_index = CullIndex(List=dispatch.ListA, Indices="0", Wrap=True)  # -> simplify(List)
duplicate_data = DuplicateData(Data=simplify(move_3.Geometry), Number=2, Order=True)
tree_statistics = TreeStatistics(Tree=move_3.Geometry)  # -> Paths, Length, Count
list_item = ListItem(List=tree_statistics.Length, Index=0, Wrap=True)
split_list = SplitList(List=simplify(duplicate_data), Index=list_item)  # -> ListA, ListB
data = Data(piperadius)
multiplication_2 = Multiplication(A=data, B="2")
unit_y = UnitY(Factor=multiplication_2)
cull_index_2 = CullIndex(List=dispatch.ListA, Indices="0", Wrap=True)  # -> simplify(List)
multiplication_3 = Multiplication(A=multiplication_2, B="3")
unit_x_4 = UnitX(Factor=multiplication_3)
negative_2 = Negative(Value=unit_y)
move_4 = Move(Geometry=split_list.ListB, Motion=unit_y)  # -> Geometry, Transform
move_5 = Move(Geometry=split_list.ListB, Motion=negative_2)  # -> Geometry, Transform
move_6 = Move(Geometry=cull_index, Motion=unit_x_4)  # -> Geometry, Transform
unit_z_2 = UnitZ(Factor=Slider(0.3, range=0.1..1))
move_7 = Move(Geometry=move_6.Geometry, Motion=negative_2)  # -> Geometry, Transform
move_8 = Move(Geometry=move_4.Geometry, Motion=unit_z_2)  # -> Geometry, Transform
move_9 = Move(Geometry=move_6.Geometry, Motion=unit_y)  # -> Geometry, Transform
negative_3 = Negative(Value=unit_z_2)
unit_z_3 = UnitZ(Factor=Slider(0.3, range=0.1..1))
move_10 = Move(Geometry=move_5.Geometry, Motion=negative_3)  # -> Geometry, Transform
negative_4 = Negative(Value=unit_z_3)
move_11 = Move(Geometry=move_7.Geometry, Motion=negative_4)  # -> Geometry, Transform
move_12 = Move(Geometry=move_9.Geometry, Motion=unit_z_3)  # -> Geometry, Transform
panel = Panel("""0
1
2
3
4""")
weave = Weave(Pattern=[0, 1], Stream0=move_2.Geometry, Stream1=cull_index_2, NullGaps=False)  # -> simplify(Weave)
weave_2 = Weave(
    Pattern=panel,
    Stream0=move_10.Geometry,
    Stream1=move_8.Geometry,
    Stream2=move_11.Geometry,
    Stream3=move_6.Geometry,
    Stream4=move_12.Geometry,
    NullGaps=False)  # -> simplify(Weave)
number_slider_3 = Slider(1, range=0.1..1)
polyline = PolyLine(Vertices=weave, Closed=False)
polyline_2 = PolyLine(Vertices=weave_2, Closed=False)
fillet = Fillet(Curve=polyline_2, Radius=number_slider_3)
fillet_2 = Fillet(Curve=polyline, Radius=number_slider_3)
pipe = Pipe(Curve=fillet_2, Radius=data, Caps=0)  # -> flatten(Pipe)
pipe_2 = Pipe(Curve=fillet, Radius=data, Caps=0)  # -> flatten(Pipe)

# ---- group: Balusters
tree_branch = TreeBranch(Tree=simplify(divide_curve.Points), Path="{0}", MaintainPaths=True)
yz_plane = YZPlane(Origin=Point(0, 0, 0))
list_item_2 = ListItem(List=tree_branch, Index=0, Wrap=True)
list_item_3 = ListItem(List=tree_branch, Index="1", Wrap=True)
data_2 = Data(baluster_radius)
distance = Distance(PointA=list_item_2, PointB=list_item_3)
circle = Circle(Plane=PlaneXY(0, 0, 0), Radius=data_2)
circle_2 = Circle(Plane=yz_plane, Radius=data_2)
multiplication_4 = Multiplication(A=data, B=2)
addition_2 = Addition(A=data_2, B=multiplication_4)
subtraction = Subtraction(A=fence_height, B=distance)
multiplication_5 = Multiplication(A=distance, B="2")
unit_y_2 = UnitY(Factor=addition_2)
division_2 = Division(A=multiplication, B="100")
merge = Merge(Data1=subtraction, Data2=multiplication_5)
unit_x_5 = UnitX(Factor="100")
unit_z_4 = UnitZ(Factor=merge)
addition_3 = Addition(A=division_2, B="1")
move_13 = Move(Geometry=circle_2, Motion=unit_z_4)  # -> Geometry, Transform
move_14 = Move(Geometry=move_13.Geometry, Motion=unit_y_2)  # -> Geometry, Transform
unit_z_5 = UnitZ(Factor=fence_height)
unit_x_6 = UnitX(Factor=multiplication)
extrude = Extrude(Base=move_14.Geometry, Direction=unit_x_6)

# ----
move_15 = Move(Geometry=circle, Motion=unit_y_2)  # -> Geometry, Transform

# ---- group: Balusters (continued)
linear_array = LinearArray(Geometry=move_15.Geometry, Direction=unit_x_5, Count=addition_3)  # -> Geometry, Transform
extrude_2 = Extrude(Base=linear_array.Geometry, Direction=unit_z_5)
cap_holes = CapHoles(Brep=extrude_2)
relay = Relay([cap_holes, extrude])

# ----
# Visualization
number_slider_4 = Slider(60, range=0..100)
merge_2 = Merge(Data1=pipe, Data2=pipe_2)
create_material = CreateMaterial(
    Diffuse=ColourSwatch(SwatchColor=RGB(168, 168, 168)),
    Specular=RGB(255, 255, 255),
    Emission=RGB(0, 0, 0),
    Transparency=0,
    Shine=number_slider_4)
custom_preview = CustomPreview(Geometry=merge_2, Material=create_material)
custom_preview_2 = CustomPreview(Geometry=relay, Material=create_material)
