# Grasshopper definition 014_SurfacePixelation.gh (Grasshopper 1.0.7)
# plug-ins: Bifocals

# ----
# Parameters
pixel_x_dimension = Slider(30, range=1..100)
pixel_y_dimension = Slider(20, range=1..100)

# ----
# Pixel Generation
# Add your surface w/ 4 vertices
geometry = Geometry(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)

negative = Negative(Value=Slider(20, range=0..20))
offset_curve = OffsetCurve(Curve=geometry, Distance=negative, Corners=1)
explode = Explode(Curve=offset_curve, Recursive=True)  # -> Segments, Vertices
md_slider = MDSlider(SliderMode=0, slider_value=Point(0.5, 0.5, 0.5), x_domain=Domain(0, 1), y_domain=Domain(0, 1), z_domain=Domain(0, 1))
cluster = Cluster(curve=offset_curve)
evaluate_surface = EvaluateSurface(Surface=geometry, Point=md_slider)  # -> Point, Normal, UDirection, VDirection, Frame
length = Length(Curve=explode.Segments)
sort_list = SortList(Keys=length)  # -> Keys, ValuesA
construct_plane = ConstructPlane(Origin=evaluate_surface.Normal, XAxis=evaluate_surface.UDirection, YAxis=evaluate_surface.VDirection)
curve_middle = CurveMiddle(Curve=explode.Segments)
data = Data(pixel_x_dimension)
data_2 = Data(pixel_y_dimension)
deconstruct = Deconstruct(Point=curve_middle)  # -> XComponent, YComponent, ZComponent
rectangle = Rectangle(Plane=construct_plane, XSize=data, YSize=data_2, Radius=0)  # -> Rectangle, Length
sort_list_2 = SortList(Keys=deconstruct.ZComponent, ValuesA=curve_middle)  # -> Keys, ValuesA
list_item = ListItem(List=sort_list.Keys, Index="1", Wrap=True)
list_item_2 = ListItem(List=sort_list.Keys, Index="3", Wrap=True)
cluster_2 = Cluster_2(curve=rectangle.Rectangle, geometry=rectangle.Rectangle, point_b=cluster)
division = Division(A=list_item_2, B=data)
division_2 = Division(A=list_item, B=data_2)
shift_list = ShiftList(List=sort_list_2.ValuesA, Shift=1, Wrap=True)
split_list = SplitList(List=shift_list, Index="2")  # -> ListA, ListB
integer = Integer(expr("x/2", division))
integer_2 = Integer(division_2)
negative_2 = Negative(Value=integer_2)
dispatch = Dispatch(List=split_list.ListB, DispatchPattern=[True, False])  # -> ListA, ListB
data_3 = Data(evaluate_surface.Normal)
rectangular_array = RectangularArray(Geometry=cluster_2, Cell=rectangle.Rectangle, XCount=integer, YCount=negative_2)  # -> Geometry, Transform
line = Line(StartPoint=dispatch.ListA, EndPoint=dispatch.ListB)
negative_3 = Negative(Value=data_3)
mirror_curve = MirrorCurve(Geometry=rectangular_array.Geometry, Curve=line, Tangent=True)
amplitude = Amplitude(Vector=[negative_3, data_3], Amplitude=Slider(50, range=0..100))
extrude = Extrude(Base=offset_curve, Direction=amplitude)
amplitude_2 = Amplitude(Vector=data_3, Amplitude=Slider(0.1, range=0..0.1))
merge = Merge(Data1=rectangular_array.Geometry, Data2=mirror_curve)
brep_join = BrepJoin(Breps=extrude)  # -> Breps, Closed
move = Move(Geometry=merge, Motion=amplitude_2)  # -> Geometry, Transform
area = Area(Geometry=move.Geometry)  # -> Area, Centroid
cap_holes = CapHoles(Brep=brep_join.Breps)
point_in_brep = PointInBrep(Brep=cap_holes, Point=area.Centroid, Strict=False)
dispatch_2 = Dispatch(List=move.Geometry, DispatchPattern=point_in_brep)  # -> ListA, ListB

# ----
# Visualization
colour_swatch = ColourSwatch(SwatchColor=RGB(107, 63, 1))
surface = Surface(dispatch_2.ListA)
custom_preview = CustomPreview(Geometry=geometry, Material=colour_swatch)
custom_preview_2 = CustomPreview(Geometry=surface, Material=ColourSwatch(SwatchColor=RGB(171, 171, 169)))

# ==== cluster Cluster
curve = ClusterInput()
explode = Explode(Curve=curve, Recursive=True)  # -> Segments, Vertices
curve_middle = CurveMiddle(Curve=explode.Segments)
cull_duplicates = CullDuplicates(Points=curve_middle, Tolerance=0.1, CullMode=3)  # -> Points, Indices, Valence
deconstruct = Deconstruct(Point=cull_duplicates.Points)  # -> XComponent, YComponent, ZComponent
list_length = ListLength(List=cull_duplicates.Points)
sort_list = SortList(Keys=deconstruct.ZComponent, ValuesValuesA=cull_duplicates.Points)  # -> Keys, reverse(ValuesValuesA)
division = Division(A=list_length, B="2")
split_list = SplitList(List=sort_list.ValuesValuesA, Index=division)  # -> ListA, ListB
deconstruct_2 = Deconstruct(Point=split_list.ListA)  # -> XComponent, YComponent, ZComponent
sort_list_2 = SortList(Keys=deconstruct_2.XComponent, ValuesValuesA=split_list.ListA)  # -> Keys, reverse(ValuesValuesA)
list_item = ListItem(List=sort_list_2.ValuesValuesA, Index=0, Wrap=True)
i = ClusterOutput(list_item)

# ==== cluster Cluster_2
curve = ClusterInput()
explode = Explode(Curve=curve, Recursive=True)  # -> Segments, Vertices
curve_middle = CurveMiddle(Curve=explode.Segments)
cull_duplicates = CullDuplicates(Points=curve_middle, Tolerance=0.1, CullMode=3)  # -> Points, Indices, Valence
deconstruct = Deconstruct(Point=cull_duplicates.Points)  # -> XComponent, YComponent, ZComponent
list_length = ListLength(List=cull_duplicates.Points)
sort_list = SortList(Keys=deconstruct.ZComponent, ValuesValuesA=cull_duplicates.Points)  # -> Keys, ValuesValuesA
division = Division(A=list_length, B="2")
split_list = SplitList(List=sort_list.ValuesValuesA, Index=division)  # -> ListA, ListB
deconstruct_2 = Deconstruct(Point=split_list.ListB)  # -> XComponent, YComponent, ZComponent
sort_list_2 = SortList(Keys=deconstruct_2.XComponent, ValuesValuesA=split_list.ListB)  # -> Keys, ValuesValuesA
list_item = ListItem(List=sort_list_2.ValuesValuesA, Index=0, Wrap=True)
geometry = ClusterInput()
point_b = ClusterInput()
move_to_point = MoveToPoint(Geometry=geometry, PointA=list_item, PointB=point_b)  # -> Moved, Vector, Transform
moved = ClusterOutput(move_to_point.Moved)
