# Grasshopper definition 015_BouncingBall.gh (Grasshopper 1.0.7)
# plug-ins: Pufferfish, Bifocals

# ----
# Trigger
trigger = Trigger(Interval=20, TimerInterval=20, Target=ghpython_script)  # disabled
ghpython_script = GhPythonScript(Reset=Button())  # -> out, a; inputs Reset: Boolean
# ---------- ghpython_script: Python ----------
__author__ = "burke"
__version__ = "2026.02.02"

if "count" not in globals() or Reset:
    count = 0
else:
    count += 1

a = count
# ---------- end ghpython_script ----------

# ----
# Ball Logic
number_slider = Slider(38, range=10..100)
concatenate = Concatenate(FragmentA="0,0,", FragmentB=number_slider)
expression = Expression(t=ghpython_script.a, Expression="100 * Abs(Sin(t/10))")
xy_plane = XYPlane(Origin=concatenate)
construct_domain = ConstructDomain(DomainStart="0", DomainEnd="100")
unit_z = UnitZ(Factor=expression)
sphere = Sphere(Base=xy_plane, Radius=number_slider)
move = Move(Geometry=sphere, Motion=unit_z)  # -> Geometry, Transform
remap_numbers = RemapNumbers(Value=unit_z, Source=construct_domain, Target=Domain(0, 1))  # -> Mapped, Clipped
number_slider_2 = Slider(1, range=0..1)
graph_mapper = GraphMapper(
    remap_numbers.Mapped,
    x0=0,
    x1=1,
    y0=0,
    y1=1,
    container_name="Bezier",
    cpx=[0, 0, 0.2616935074, 1],
    cpy=[0.4054199457, 0.9691802263, 1, 1])
scale_nu = ScaleNU(Geometry=move.Geometry, Plane=PlaneXY(0, 0, 0), ScaleX=number_slider_2, ScaleY=number_slider_2, ScaleZ=graph_mapper)  # -> Geometry, Transform

negative = Negative(Value="5")
unit_z_2 = UnitZ(Factor=negative)

# ----
# Ground (Optional)
number_slider_3 = Slider(20, range=0..100)
multiplication = Multiplication(A=number_slider, B="2")
area = Area(Geometry=sphere)  # -> Area, Centroid
addition = Addition(A=multiplication, B=number_slider_3)
project = Project(Geometry=area.Centroid, Plane=PlaneXY(0, 0, 0))  # -> Geometry, Transform
rectangle = Rectangle(Plane=PlaneXY(0, 0, 0), XSize=addition, YSize=addition, Radius=0)  # -> Rectangle, Length
area_2 = Area(Geometry=rectangle.Rectangle)  # -> Area, Centroid
move_to_point = MoveToPoint(Geometry=rectangle.Rectangle, PointA=area_2.Centroid, PointB=project.Geometry)  # -> Moved, Vector, Transform

extrude = Extrude(Base=move_to_point.Moved, Direction=unit_z_2)

cap_holes = CapHoles(Brep=extrude)

# ----
# Visualization
colour_swatch = ColourSwatch(SwatchColor=RGB(110, 102, 94))
create_material = CreateMaterial(
    Diffuse=ColourSwatch(SwatchColor=RGB(255, 132, 0)),
    Specular=RGB(255, 255, 255),
    Emission=RGB(0, 0, 0),
    Transparency=0,
    Shine=Slider(85, range=0..100))
create_material_2 = CreateMaterial(
    Diffuse=colour_swatch,
    Specular=RGB(255, 255, 255),
    Emission=RGB(0, 0, 0),
    Transparency=0,
    Shine=Slider(95, range=0..100))
custom_preview = CustomPreview(Geometry=cap_holes, Material=create_material_2)
custom_preview_2 = CustomPreview(Geometry=scale_nu.Geometry, Material=create_material)
