# Grasshopper definition 016_CurveAttractor.gh (Grasshopper 1.0.7)
# plug-ins: Bifocals

crv = Curve(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)
srf = Surface(reparameterize(crv))
divide = DivideDomain²(Domain=srf, UCount=Slider(40, range=0..100), VCount=Slider(27, range=0..100))
subsrf = Isotrim(Surface=srf, Domain=divide)
area = Area(Geometry=subsrf)  # -> Area, Centroid
list_item = ListItem(List=subsrf, Index=0, Wrap=True)
curve = Curve(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)
explode = Explode(Curve=list_item, Recursive=True)  # -> Segments, Vertices
curve_closest_point = CurveClosestPoint(Point=area.Centroid, Curve=curve)  # -> Point, Parameter, Distance
construct_domain = ConstructDomain(DomainStart=Slider(90, range=0..100), DomainEnd=Slider(10, range=0..10))
bounds = Bounds(Numbers=curve_closest_point.Distance)
length = Length(Curve=explode.Segments)
remap_numbers = RemapNumbers(Value=curve_closest_point.Distance, Source=bounds, Target=construct_domain)  # -> simplify(graft(Mapped)), Clipped
area_2 = Area(Geometry=subsrf)  # -> Area, Centroid
sort_list = SortList(Keys=length, ValuesA=explode.Segments)  # -> Keys, ValuesA
xz_plane = XZPlane(Origin=area_2.Centroid)
list_item_2 = ListItem(List=sort_list.Keys, Index=0, Wrap=True)
circle = Circle(Plane=xz_plane, Radius=expr("x/2", list_item_2))
area_3 = Area(Geometry=circle)  # -> Area, graft(Centroid)
rotate = Rotate(Geometry=simplify(graft(circle)), Angle=degrees(remap_numbers.Mapped), Plane=simplify(graft(area_3.Centroid)))  # -> Geometry, Transform
surface = Surface(rotate.Geometry)
create_material = CreateMaterial(
    Diffuse=ColourSwatch(SwatchColor=RGB(255, 183, 0)),
    Specular=RGB(255, 255, 255),
    Emission=RGB(0, 0, 0),
    Transparency=0,
    Shine=Slider(80, range=0..100))
custom_preview = CustomPreview(Geometry=surface, Material=create_material)
