# Grasshopper definition 017_PaneledMobiusStrip.gh (Grasshopper 1.0.7)
# plug-ins: Bifocals, LunchBox

# ----
# Mobius Strip
number_slider = Slider(30, range=20..100)
number_slider_2 = Slider(20, range=20..100)
cir = Circle(Plane=PlaneXY(0, 0, 0), Radius=number_slider)
divide = DivideCurve(Curve=cir, Count=number_slider_2, Kinks=False)  # -> Points, Tangents, Parameters
Z = UnitZ(Factor=1)
line = LineSDL(Start=divide.Points, Direction=Z, Length=Slider(15, range=10..100))
midpt = CurveMiddle(Curve=line)
line_2 = LineSDL(Start=midpt, Direction=divide.Tangents, Length=1)
lnln = LineLine(LineA=line_2, LineB=line)
padjust = AdjustPlane(Plane=lnln, Normal=divide.Tangents)
dom = ConstructDomain(DomainStart="0", DomainEnd="90")
range = Range(Domain=dom, Steps=expr("(x/2)-1", number_slider_2))
data = Data(reverse(range))
merge = Merge(Data1=range, Data2=data)
rotate = Rotate(Geometry=line, Angle=degrees(merge), Plane=padjust)  # -> Geometry, Transform
loft_opt = LoftOptions(Closed=Toggle(True), Adjust=False, Rebuild=0, Refit=0, Type=0)
loft = Loft(Curves=rotate.Geometry, Options=loft_opt)

# ----
# Paneling
number_slider_3 = Slider(30, range=0..50)
diamond = DiamondPanels(Surface=loft, UDivisions=number_slider_3, VDivisions=Slider(8, range=1..50))  # -> DiamondPanels, TriPanels
md_slider = MDSlider(SliderMode=0, slider_value=Point(0.5, 0.5, 0.5), x_domain=Domain(0, 1), y_domain=Domain(0, 1), z_domain=Domain(0, 1))
debrep = DeconstructBrep(Brep=diamond.DiamondPanels)  # -> Faces, Edges, simplify(Vertices)
evalsrf = EvaluateSurface(Surface=diamond.DiamondPanels, Point=md_slider)  # -> Point, Normal, UDirection, VDirection, Frame
pdecon = Deconstruct(Point=debrep.Vertices)  # -> XComponent, YComponent, ZComponent
sort = SortList(Keys=pdecon.ZComponent, ValuesA=debrep.Vertices)  # -> Keys, ValuesA
pt = ConstructPoint(XCoordinate=Slider(50, range=1..50), YCoordinate=0, ZCoordinate=Slider(36, range=1..50))
area = Area(Geometry=diamond.DiamondPanels)  # -> Area, Centroid
item = ListItem(List=sort.ValuesA, Index=0, Wrap=True)
dist = Distance(PointA=pt, PointB=item)
bnd = Bounds(Numbers=flatten(dist))
dom_2 = ConstructDomain(DomainStart=Slider(5.81, range=0.1..10), DomainEnd=Slider(2.2, range=0.1..10))
remap = RemapNumbers(Value=flatten(dist), Source=bnd, Target=dom_2)  # -> Mapped, Clipped
amp = Amplitude(Vector=evalsrf.Normal, Amplitude=remap.Mapped)
move = Move(Geometry=area.Centroid, Motion=amp)  # -> simplify(graft(Geometry)), Transform
ln = Line(StartPoint=debrep.Vertices, EndPoint=move.Geometry)
merge_2 = Merge(Data1=simplify(debrep.Edges), Data2=ln)

# ----
# Curve Splitting for
# Surface Generation
panel = Panel("""0
4
5""")
panel_2 = Panel("""1
5
6""")
panel_3 = Panel("""2
6
7""")
panel_4 = Panel("""3
7
4""")
item_2 = ListItem(List=merge_2, Index=panel, Wrap=True)
item_3 = ListItem(List=merge_2, Index=panel_2, Wrap=True)
item_4 = ListItem(List=merge_2, Index=panel_3, Wrap=True)
item_5 = ListItem(List=merge_2, Index=panel_4, Wrap=True)

srf = Surface(diamond.TriPanels)
merge_3 = Merge(Data1=item_2, Data2=item_3, Data3=item_4, Data4=item_5)
boundary = BoundarySurfaces(Edges=merge_3)

# ----
# Visualization
number_slider_4 = Slider(20, range=0..100)
material = CreateMaterial(
    Diffuse=ColourSwatch(SwatchColor=RGB(94, 94, 94)),
    Specular=RGB(255, 255, 255),
    Emission=RGB(0, 0, 0),
    Transparency=0,
    Shine=number_slider_4)
material_2 = CreateMaterial(
    Diffuse=ColourSwatch(SwatchColor=RGB(178, 178, 178)),
    Specular=RGB(255, 255, 255),
    Emission=RGB(0, 0, 0),
    Transparency=0,
    Shine=Slider(20, range=0..100))
preview = CustomPreview(Geometry=srf, Material=material)
preview_2 = CustomPreview(Geometry=[boundary, srf], Material=material_2)
