# Grasshopper definition 018_TexturedWall.gh (Grasshopper 1.0.7)
# plug-ins: Bifocals

X = UnitX(Factor=1)
line = LineSDL(Start="0,0,0", Direction=X, Length=Slider(600, range=100..1000))
Z = UnitZ(Factor=Slider(200, range=10..200))
extr = Extrude(Base=line, Direction=Z)
contour = Contour(Shape=extr, Point=Point(0, 0, 0), Direction=Vector(0, 0, 1), Distance=Slider(10, range=10..100))  # -> simplify(Contours)
dom = ConstructDomain(DomainStart=Slider(30, range=0..100), DomainEnd=Slider(80, range=0..100))
lng = ListLength(List=flatten(contour))
random = Random(Range=dom, Number=lng, Seed=2)
int = Integer(random)
divide = DivideCurve(Curve=flatten(contour), Count=int, Kinks=False)  # -> simplify(Points), Tangents, Parameters
lng_2 = ListLength(List=divide.Points)
dom_2 = ConstructDomain(DomainStart=Slider(1, range=0..100), DomainEnd=Slider(5, range=0..100))
random_2 = Random(Range=dom_2, Number=lng_2, Seed=2)
Y = UnitY(Factor=random_2)
neg = Negative(Value=Y)
move = Move(Geometry=divide.Points, Motion=neg)  # -> Geometry, Transform
intcrv = Interpolate(Vertices=move.Geometry, Degree=3, Periodic=False, KnotStyle=1)  # -> Curve, Length, Domain
crv = Curve(contour)
end = EndPoints(Curve=crv)  # -> Start, End
end_2 = EndPoints(Curve=intcrv.Curve)  # -> Start, End
ln = Line(StartPoint=end_2.Start, EndPoint=end.Start)
ln_2 = Line(StartPoint=end_2.End, EndPoint=end.End)
merge = Merge(Data1=simplify(intcrv.Curve), Data2=simplify(crv), Data3=simplify(ln), Data4=simplify(ln_2))
boundary = BoundarySurfaces(Edges=merge)
preview = CustomPreview(Geometry=boundary, Material=ColourSwatch(SwatchColor=RGB(204, 204, 204)))
preview_2 = CustomPreview(Geometry=extr, Material=ColourSwatch(SwatchColor=RGB(161, 161, 161)))
