# Grasshopper definition 019_VoxelTower.gh (Grasshopper 1.0.7)
# plug-ins: Bifocals

# ----
# Main Geometry
number_slider = Slider(320, range=0..1000)
number_slider_2 = Slider(990, range=0..1000)
number_slider_3 = Slider(320, range=0..1000)
pt = ConstructPoint(XCoordinate=number_slider, YCoordinate=number_slider_3, ZCoordinate=number_slider_2)
box = Box2Pt(PointA="0,0,0", PointB=pt, Plane=PlaneXY(0, 0, 0))

# ----
# Voxel
number_slider_4 = Slider(20, range=0..100)
number_slider_5 = Slider(20, range=0..100)
number_slider_6 = Slider(20, range=0..100)
pt_2 = ConstructPoint(XCoordinate=number_slider_6, YCoordinate=number_slider_4, ZCoordinate=number_slider_5)
box_2 = Box2Pt(PointA="0,0,0", PointB=pt_2, Plane=PlaneXY(0, 0, 0))

# ----
# Methodology
number_slider_7 = Slider(22, range=0..100)
numberofspheres = Slider(28, range=0..100)
integer_division = IntegerDivision(A=number_slider, B=number_slider_6)
integer_division_2 = IntegerDivision(A=number_slider_3, B=number_slider_4)
integer_division_3 = IntegerDivision(A=number_slider_2, B=number_slider_5)
arrbox = BoxArray(Geometry=box_2, Cell=box_2, XCount=integer_division, YCount=integer_division_2, ZCount=integer_division_3)  # -> Geometry, Transform
pop3d = Populate3D(Region=box, Count=numberofspheres, Seed=number_slider_7)
sphereradius_max = Slider(86, range=0..100)
sphereradius_min = Slider(64, range=0..100)
dom = ConstructDomain(DomainStart=sphereradius_min, DomainEnd=sphereradius_max)
lng = ListLength(List=flatten(pop3d))
area = Area(Geometry=arrbox.Geometry)  # -> Area, Centroid
range = Range(Domain=dom, Steps=lng)
sph = Sphere(Base=flatten(pop3d), Radius=range)
sdiff = SolidDifference(BrepsA=box, BrepsB=sph)
brepinc = PointInBrep(Brep=sdiff, Point=area.Centroid, Strict=False)
dispatch = Dispatch(List=arrbox.Geometry, DispatchPattern=brepinc)  # -> ListA, ListB

# ----
# Visualization
number_slider_8 = Slider(60, range=0..100)
material = CreateMaterial(
    Diffuse=ColourSwatch(SwatchColor=RGB(180, 209, 217)),
    Specular=RGB(255, 255, 255),
    Emission=RGB(0, 0, 0),
    Transparency=0,
    Shine=number_slider_8)
preview = CustomPreview(Geometry=dispatch.ListA, Material=material)
