# Grasshopper definition 020_PanelPlacer.gh (Grasshopper 1.0.7)
# plug-ins: Bifocals, LunchBox, Pufferfish

X = UnitX(Factor=1)
line = LineSDL(Start="0,0,0", Direction=X, Length=Slider(500, range=0..1000))
number_slider = Slider(250, range=0..1000)
Z = UnitZ(Factor=number_slider)
extr = Extrude(Base=line, Direction=Z)
trib = TrianglePanelsB(Surface=extr, UDivisions=Slider(20, range=0..100), VDivisions=Slider(25, range=0..100))
shuffleseed = Slider(36, range=0..100)
jitter = Jitter(List=trib, Jitter=1, Seed=shuffleseed)  # -> Values, Indices

item = ListItem(List=jitter.Values, Index=0, Wrap=True)
panelmesh = Geometry(item)
area = Area(Geometry=panelmesh)  # -> Area, Centroid
yz = YZPlane(Origin=area.Centroid)
rotate = Rotate(Geometry=panelmesh, Angle=expr("90", degrees(1.570796327)), Plane=yz)  # -> Geometry, Transform
move2pt = MoveToPoint(Geometry=rotate.Geometry, PointA=area.Centroid, PointB="0,-100,0")  # -> Moved, Vector, Transform

# ----
# Panel 2
number_slider_2 = Slider(1.65, range=0.1..5)
neg = Negative(Value=number_slider_2)
offset = OffsetCurve(Curve=move2pt.Moved, Distance=neg, Corners=1)
contour = Contour(Shape=offset, Point=area.Centroid, Direction="0,1,0", Distance=Slider(3.07, range=0..5))  # -> simplify(Contours)
lng = ListLength(List=flatten(contour))
series = Series(Start="2", Step="3", Count=lng)  # -> reverse(Series)
divide = DivideCurve(Curve=flatten(contour), Count=flatten(series), Kinks=False)  # -> Points, Tangents, Parameters
number_slider_3 = Slider(0.31, range=0..5)
cir = Circle(Plane=divide.Points, Radius=Slider(0.91, range=0..5))
Z_2 = UnitZ(Factor=number_slider_3)
Z_3 = UnitZ(Factor=number_slider_3)
extr_2 = Extrude(Base=move2pt.Moved, Direction=Z_2)
extr_3 = Extrude(Base=cir, Direction=Z_3)
cap = CapHoles(Brep=extr_2)
cap_2 = CapHoles(Brep=extr_3)
sdiff = SolidDifference(BrepsA=cap, BrepsB=flatten(cap_2))
panel_2 = Geometry(sdiff)

# ----
# Panel 1
panel = Panel("50,-100,0")
area_2 = Area(Geometry=move2pt.Moved)  # -> Area, Centroid
move2pt_2 = MoveToPoint(Geometry=move2pt.Moved, PointA=area_2.Centroid, PointB=panel)  # -> Moved, Vector, Transform
extr_4 = Extrude(Base=move2pt_2.Moved, Direction=Z_2)
cap_3 = CapHoles(Brep=extr_4)
panel_1 = Geometry(cap_3)

# ---- group: Panel_3
# Panel 3
number_slider_4 = Slider(2, range=0.1..5)
move2pt_3 = MoveToPoint(Geometry=move2pt.Moved, PointA=area_2.Centroid, PointB="100,-100,0")  # -> Moved, Vector, Transform
neg_2 = Negative(Value=number_slider_4)
offset_2 = OffsetCurve(Curve=move2pt_3.Moved, Distance=neg_2, Corners=1)
contour_2 = Contour(Shape=offset_2, Point=area.Centroid, Direction="0,1,0", Distance=Slider(4.02, range=0..5))  # -> simplify(Contours)
lng_2 = ListLength(List=flatten(contour_2))
series_2 = Series(Start="2", Step="3", Count=lng_2)  # -> reverse(Series)
divide_2 = DivideCurve(Curve=flatten(contour_2), Count=flatten(series_2), Kinks=False)  # -> Points, Tangents, Parameters
number_slider_5 = Slider(0.31, range=0..5)
cir_2 = Circle(Plane=divide_2.Points, Radius=Slider(1.27, range=0..5))
Z_4 = UnitZ(Factor=number_slider_5)
Z_5 = UnitZ(Factor=number_slider_5)
extr_5 = Extrude(Base=move2pt_3.Moved, Direction=Z_4)
extr_6 = Extrude(Base=cir_2, Direction=Z_5)
cap_4 = CapHoles(Brep=extr_5)
cap_5 = CapHoles(Brep=extr_6)
sdiff_2 = SolidDifference(BrepsA=cap_4, BrepsB=flatten(cap_5))
panel_3 = Geometry(sdiff_2)

# ----
# Panel 1 Rotation
area_3 = Area(Geometry=panel_1)  # -> Area, Centroid
yz_2 = YZPlane(Origin=area_3.Centroid)
rotate_2 = Rotate(Geometry=panel_1, Angle=expr("90", degrees(1.570796327)), Plane=yz_2)  # -> Geometry, Transform
xz = XZPlane(Origin=area_3.Centroid)
rotate_3 = Rotate(Geometry=rotate_2.Geometry, Angle=expr("180", degrees(1.570796327)), Plane=xz)  # -> Geometry, Transform
panel1_up = Geometry(rotate_2.Geometry)
panel1_down = Geometry(rotate_3.Geometry)
bbox = BoundingBox(Content=panel1_up, Plane=PlaneXY(0, 0, 0))  # -> Box, Box_2
bbox_2 = BoundingBox(Content=panel1_down, Plane=PlaneXY(0, 0, 0))  # -> Box, Box_2
area_4 = Area(Geometry=bbox.Box)  # -> Area, Centroid
area_5 = Area(Geometry=bbox_2.Box)  # -> Area, Centroid

# ----
# Panel 2 Rotation
area_6 = Area(Geometry=panel_2)  # -> Area, Centroid
yz_3 = YZPlane(Origin=area_6.Centroid)
rotate_4 = Rotate(Geometry=panel_2, Angle=expr("90", degrees(1.570796327)), Plane=yz_3)  # -> Geometry, Transform
xz_2 = XZPlane(Origin=area_6.Centroid)
rotate_5 = Rotate(Geometry=rotate_4.Geometry, Angle=expr("180", degrees(1.570796327)), Plane=xz_2)  # -> Geometry, Transform
panel2_up = Geometry(rotate_4.Geometry)
panel2_down = Geometry(rotate_5.Geometry)
bbox_3 = BoundingBox(Content=panel2_up, Plane=PlaneXY(0, 0, 0))  # -> Box, Box_2
bbox_4 = BoundingBox(Content=panel2_down, Plane=PlaneXY(0, 0, 0))  # -> Box, Box_2
area_7 = Area(Geometry=bbox_3.Box)  # -> Area, Centroid
area_8 = Area(Geometry=bbox_4.Box)  # -> Area, Centroid

# ----
# Panel 3 Rotation
area_9 = Area(Geometry=panel_3)  # -> Area, Centroid
yz_4 = YZPlane(Origin=area_9.Centroid)
rotate_6 = Rotate(Geometry=panel_3, Angle=expr("90", degrees(1.570796327)), Plane=yz_4)  # -> Geometry, Transform
xz_3 = XZPlane(Origin=area_9.Centroid)
rotate_7 = Rotate(Geometry=rotate_6.Geometry, Angle=expr("180", degrees(1.570796327)), Plane=xz_3)  # -> Geometry, Transform
panel3_up = Geometry(rotate_6.Geometry)
panel3_down = Geometry(rotate_7.Geometry)
bbox_5 = BoundingBox(Content=panel3_up, Plane=PlaneXY(0, 0, 0))  # -> Box, Box_2
bbox_6 = BoundingBox(Content=panel3_down, Plane=PlaneXY(0, 0, 0))  # -> Box, Box_2
area_10 = Area(Geometry=bbox_5.Box)  # -> Area, Centroid
area_11 = Area(Geometry=bbox_6.Box)  # -> Area, Centroid

randomseed = Slider(30, range=0..100)

# ----
# Panel Elimination and Random Split
area_12 = Area(Geometry=jitter.Values)  # -> Area, Centroid
sort = SortList(Keys=area_12.Area)  # -> Keys, ValuesA
item_2 = ListItem(List=reverse(sort.Keys), Index=0, Wrap=True)
int = Integer(area_12.Area)
int_2 = Integer(item_2)
larger = LargerThan(FirstNumber=int, SecondNumber=int_2)  # -> LargerThan, OrEqualTo
dispatch = Dispatch(List=jitter.Values, DispatchPattern=larger.OrEqualTo)  # -> ListA, ListB
randomsplit = RandomSplitList(MasterList=dispatch.ListA, Seed=randomseed, Split=Slider(0.7, range=0..1))  # -> ListA, ListB
randomsplit_2 = RandomSplitList(MasterList=randomsplit.ListB, Seed=2, Split=0.5)  # -> ListA, ListB

# ----
# Panel Dist. Info
number_slider_6 = Slider(300, range=0..1000)
addition = Addition(A=number_slider, B=number_slider_6)
X_2 = UnitX(Factor=addition)
move = Move(Geometry=randomsplit.ListA, Motion=X_2)  # -> Geometry, Transform
move_2 = Move(Geometry=randomsplit_2.ListA, Motion=X_2)  # -> Geometry, Transform
move_3 = Move(Geometry=randomsplit_2.ListB, Motion=X_2)  # -> Geometry, Transform
move_4 = Move(Geometry=dispatch.ListB, Motion=X_2)  # -> Geometry, Transform

# ----
# Panel 1 Dispatch
debrep = DeconstructBrep(Brep=randomsplit.ListA)  # -> Faces, Edges, simplify(Vertices)
pdecon = Deconstruct(Point=debrep.Vertices)  # -> XComponent, YComponent, ZComponent
sort_2 = SortList(Keys=pdecon.ZComponent)  # -> Keys, ValuesA
item_3 = ListItem(List=sort_2.Keys, Index="0", Wrap=True)
item_4 = ListItem(List=sort_2.Keys, Index="1", Wrap=True)
item_5 = ListItem(List=sort_2.Keys, Index="2", Wrap=True)
subtraction = Subtraction(A=item_4, B=item_3)
subtraction_2 = Subtraction(A=item_5, B=item_4)
smaller = SmallerThan(FirstNumber=subtraction_2, SecondNumber=subtraction)  # -> flatten(SmallerThan), OrEqualTo
dispatch_2 = Dispatch(List=randomsplit.ListA, DispatchPattern=smaller.SmallerThan)  # -> ListA, ListB
down = Geometry(dispatch_2.ListA)
up = Geometry(dispatch_2.ListB)
bbox_7 = BoundingBox(Content=down, Plane=PlaneXY(0, 0, 0))  # -> Box, Box_2
bbox_8 = BoundingBox(Content=up, Plane=PlaneXY(0, 0, 0))  # -> Box, Box_2

# ----
# Panel 2 Dispatch
debrep_2 = DeconstructBrep(Brep=randomsplit_2.ListA)  # -> Faces, Edges, simplify(Vertices)
pdecon_2 = Deconstruct(Point=debrep_2.Vertices)  # -> XComponent, YComponent, ZComponent
sort_3 = SortList(Keys=pdecon_2.ZComponent)  # -> Keys, ValuesA
item_6 = ListItem(List=sort_3.Keys, Index="0", Wrap=True)
item_7 = ListItem(List=sort_3.Keys, Index="1", Wrap=True)
item_8 = ListItem(List=sort_3.Keys, Index="2", Wrap=True)
subtraction_3 = Subtraction(A=item_7, B=item_6)
subtraction_4 = Subtraction(A=item_8, B=item_7)
smaller_2 = SmallerThan(FirstNumber=subtraction_4, SecondNumber=subtraction_3)  # -> flatten(SmallerThan), OrEqualTo
dispatch_3 = Dispatch(List=randomsplit_2.ListA, DispatchPattern=smaller_2.SmallerThan)  # -> ListA, ListB
up_2 = Geometry(dispatch_3.ListB)
down_2 = Geometry(dispatch_3.ListA)
bbox_9 = BoundingBox(Content=down_2, Plane=PlaneXY(0, 0, 0))  # -> Box, Box_2
bbox_10 = BoundingBox(Content=up_2, Plane=PlaneXY(0, 0, 0))  # -> Box, Box_2

# ----
# Panel 3 Dispatch
debrep_3 = DeconstructBrep(Brep=randomsplit_2.ListB)  # -> Faces, Edges, simplify(Vertices)
pdecon_3 = Deconstruct(Point=debrep_3.Vertices)  # -> XComponent, YComponent, ZComponent
sort_4 = SortList(Keys=pdecon_3.ZComponent)  # -> Keys, ValuesA
item_9 = ListItem(List=sort_4.Keys, Index="0", Wrap=True)
item_10 = ListItem(List=sort_4.Keys, Index="1", Wrap=True)
item_11 = ListItem(List=sort_4.Keys, Index="2", Wrap=True)
subtraction_5 = Subtraction(A=item_10, B=item_9)
subtraction_6 = Subtraction(A=item_11, B=item_10)
smaller_3 = SmallerThan(FirstNumber=subtraction_6, SecondNumber=subtraction_5)  # -> flatten(SmallerThan), OrEqualTo
dispatch_4 = Dispatch(List=randomsplit_2.ListB, DispatchPattern=smaller_3.SmallerThan)  # -> ListA, ListB
up_3 = Geometry(dispatch_4.ListB)
down_3 = Geometry(dispatch_4.ListA)
bbox_11 = BoundingBox(Content=down_3, Plane=PlaneXY(0, 0, 0))  # -> Box, Box_2
bbox_12 = BoundingBox(Content=up_3, Plane=PlaneXY(0, 0, 0))  # -> Box, Box_2

panel_1_location = Data(area_3.Centroid)
panel_2_location = Data(area_6.Centroid)
panel_3_location = Data(area_9.Centroid)
# Number of Panels
number_slider_7 = Slider(20, range=0..100)
Y = UnitY(Factor=number_slider_7)  # -> expr("-x", UnitVector)
move_5 = Move(Geometry=panel_1_location, Motion=Y)  # -> Geometry, Transform
move_6 = Move(Geometry=panel_2_location, Motion=Y)  # -> Geometry, Transform
move_7 = Move(Geometry=panel_3_location, Motion=Y)  # -> Geometry, Transform
text_size = Slider(11, range=0..100)
lng_3 = ListLength(List=move.Geometry)
lng_4 = ListLength(List=move_2.Geometry)
lng_5 = ListLength(List=move_3.Geometry)
tag = TextTag3D(Location=move_5.Geometry, Text=lng_3, Size=text_size, Justification=7)
tag_2 = TextTag3D(Location=move_6.Geometry, Text=lng_4, Size=text_size, Justification=7)
tag_3 = TextTag3D(Location=move_7.Geometry, Text=lng_5, Size=text_size, Justification=7)

# ---- group: Panel 1 Up
area_13 = Area(Geometry=bbox_8.Box)  # -> Area, Centroid
move2pt_4 = MoveToPoint(Geometry=panel1_up, PointA=area_4.Centroid, PointB=area_13.Centroid)  # -> Moved, Vector, Transform

# ---- group: Panel 1 Down
area_14 = Area(Geometry=bbox_7.Box)  # -> Area, Centroid
move2pt_5 = MoveToPoint(Geometry=panel1_down, PointA=area_5.Centroid, PointB=area_14.Centroid)  # -> Moved, Vector, Transform

# ---- group: Panel 2 Up
area_15 = Area(Geometry=bbox_10.Box)  # -> Area, Centroid
move2pt_6 = MoveToPoint(Geometry=panel2_up, PointA=area_7.Centroid, PointB=area_15.Centroid)  # -> Moved, Vector, Transform

# ----
area_16 = Area(Geometry=bbox_9.Box)  # -> Area, Centroid
move2pt_7 = MoveToPoint(Geometry=panel2_down, PointA=area_8.Centroid, PointB=area_16.Centroid)  # -> Moved, Vector, Transform

# ---- group: Panel 3 Up
area_17 = Area(Geometry=bbox_12.Box)  # -> Area, Centroid
move2pt_8 = MoveToPoint(Geometry=panel3_up, PointA=area_10.Centroid, PointB=area_17.Centroid)  # -> Moved, Vector, Transform

# ---- group: Panel 3 Down
area_18 = Area(Geometry=bbox_11.Box)  # -> Area, Centroid
move2pt_9 = MoveToPoint(Geometry=panel3_down, PointA=area_11.Centroid, PointB=area_18.Centroid)  # -> Moved, Vector, Transform

# ----
geo = Geometry(dispatch.ListB)
merge = Merge(
    Data1=move2pt_4.Moved,
    Data2=move2pt_5.Moved,
    Data3=move2pt_6.Moved,
    Data4=move2pt_7.Moved,
    Data5=move2pt_8.Moved,
    Data6=move2pt_9.Moved,
    Data7=geo)
preview = CustomPreview(Geometry=merge, Material=ColourSwatch(SwatchColor=RGB(224, 224, 224)))
preview_2 = CustomPreview(Geometry=move.Geometry, Material=ColourSwatch(SwatchColor=RGB(255, 38, 38)))
preview_3 = CustomPreview(Geometry=move_2.Geometry, Material=ColourSwatch(SwatchColor=RGB(38, 161, 255)))
preview_4 = CustomPreview(Geometry=move_3.Geometry, Material=ColourSwatch(SwatchColor=RGB(135, 193, 255)))
preview_5 = CustomPreview(Geometry=move_4.Geometry, Material=ColourSwatch(SwatchColor=RGB(186, 219, 255)))
