# Grasshopper definition 021_CustomPattern1.gh (Grasshopper 1.0.7)
# plug-ins: Bifocals, Human

# Note:
# Inspired by the video of Gediminas Kirdeikis
# Link: https://www.youtube.com/watch?v=Rb5CRIXT3Fc
number_slider = Slider(30, range=0..100)
polygon = Polygon(Plane=PlaneXY(0, 0, 0), Radius=number_slider, Segments="6", FilletRadius=0)  # -> Polygon, Length
expression = Expression(x=number_slider, Expression="x*1.5")
expression_2 = Expression(x=number_slider, Expression="(Sqrt(3)*x)/2")
vec = VectorXYZ(XComponent=expression, YComponent=expression_2, ZComponent=0)  # -> Vector, Length
move = Move(Geometry=polygon.Polygon, Motion=vec.Vector)  # -> Geometry, Transform
expression_3 = Expression(x=number_slider, Expression="(Sqrt(3)*x)")
expression_4 = Expression(x=number_slider, Expression="x*3")
merge = Merge(Data1=polygon.Polygon, Data2=move.Geometry)
array_count = Slider(20, range=0..100)
vec_2 = VectorXYZ(XComponent=expression_4, YComponent=0, ZComponent=0)  # -> Vector, Length
arrlinear = LinearArray(Geometry=merge, Direction=vec_2.Vector, Count=array_count)  # -> Geometry, Transform
vec_3 = VectorXYZ(XComponent=0, YComponent=expression_3, ZComponent=0)  # -> Vector, Length
arrlinear_2 = LinearArray(Geometry=arrlinear.Geometry, Direction=vec_3.Vector, Count=array_count)  # -> flatten(Geometry), Transform
basearray = Curve(graft(arrlinear_2.Geometry))
explode = Explode(Curve=basearray, Recursive=True)  # -> Segments, Vertices
branch = TreeBranch(Tree=simplify(explode.Segments), Path="{0}", MaintainPaths=True)
midpt = CurveMiddle(Curve=explode.Segments)
item = ListItem(List=midpt, Index=0, Wrap=True)  # -> Item, Item1
item_2 = ListItem(List=branch, Index=0, Wrap=True)
end = EndPoints(Curve=item_2)  # -> Start, End
number_slider_2 = Slider(3, range=0..3)
vec2pt = Vector2Pt(PointA=end.End, PointB=end.Start, Unitize=False)  # -> Vector, Length
neg = Negative(Value=number_slider_2)
X = UnitX(Factor=expr("x*10", neg))
amp = Amplitude(Vector=vec2pt.Vector, Amplitude=number_slider_2)
bzspan = BezierSpan(StartPoint=item.Item, StartTangent=X, EndPoint=item.Item1, EndTangent=amp)  # -> simplify(Curve), Length, Domain
pcen = PolygonCenter(Polyline=basearray)  # -> CenterV, CenterE, CenterA
panel = Panel("""120
240""")
rot3d = Rotate3D(Geometry=simplify(bzspan.Curve), Angle=degrees(panel), Center=simplify(pcen.CenterV), Axis=Vector(0, 0, 1))  # -> Geometry, Transform
random_seed = Slider(25, range=0..100)
merge_2 = Merge(Data1=rot3d.Geometry, Data2=bzspan.Curve)
center = Point(pcen.CenterV)
tstat = TreeStatistics(Tree=merge_2)  # -> Paths, Length, Count
random = Random(Range="0 to 5", Number=tstat.Count, Seed=random_seed, Integers=True)
multiplication = Multiplication(A=random, B="60")  # -> graft(Result)
rot3d_2 = Rotate3D(Geometry=simplify(merge_2), Angle=simplify(degrees(multiplication)), Center=simplify(center), Axis=Vector(0, 0, 1))  # -> Geometry, Transform
previewlw = CustomPreviewLineweights(
    Geometry=rot3d_2.Geometry,
    Shader=ColourSwatch(SwatchColor=RGB(255, 255, 255)),
    Thickness=Slider(3, range=0..5),
    Absolute=False)
