# Grasshopper definition 022_ParametricRectangleFacade.gh (Grasshopper 1.0.7)
# plug-ins: Bifocals

floor_height = Slider(5, range=0..10)
numberoffloors = Slider(5, range=0..10)

# ----
# Division Control
numberofdivisions = Slider(7, range=2..20)
range = Range(Domain=Domain(0, 1), Steps=numberofdivisions)
graph = GraphMapper(
    range,
    x0=0,
    x1=1,
    y0=0,
    y1=1,
    container_name="Bezier",
    cpx=[0, 0.3158832192, 0.6082068682, 1],
    cpy=[0, 0.5517501831, 0.8028774858, 1])

# ----
# Panels
series = Series(Start=0, Step=floor_height, Count=numberoffloors)
concat = Concatenate(FragmentA="0,0,", FragmentB=series)
X = UnitX(Factor=1)
line = LineSDL(Start=concat, Direction=X, Length=Slider(50, range=0..100))
merge = Merge(Data1=line)
crv = Curve(reparameterize(merge))
shatter = Shatter(Curve=crv, Parameters=graph)
len = Length(Curve=shatter)  # -> simplify(Length)
tstat = TreeStatistics(Tree=len)  # -> Paths, Length, Count
lng = ListLength(List=tstat.Paths)
division = Division(A=lng, B=2)
round = Round(Number=division)  # -> Nearest, Floor, Ceiling
series_2 = Series(Start="0", Step="2", Count=round.Nearest)
lng_2 = ListLength(List=series_2)
subtraction = Subtraction(A=lng, B=lng_2)
series_3 = Series(Start="1", Step="2", Count=subtraction)
branch = TreeBranch(Tree=len, Path=series_3, MaintainPaths=True)
branch_2 = TreeBranch(Tree=len, Path=series_2, MaintainPaths=True)
rev = ReverseList(List=branch_2)
merge_2 = Merge(Data1=branch, Data2=rev)
ma = MassAddition(Input=merge_2)  # -> Result, PartialResults
pt = ConstructPoint(XCoordinate=ma.PartialResults, YCoordinate=0, ZCoordinate=graft(series))
lng_3 = ListLength(List=ma.PartialResults)
data = Data(simplify(graft(concat)))
cull_i = CullIndex(List=pt, Indices=expr("x-1", lng_3), Wrap=True)  # -> simplify(List)
merge_3 = Merge(Data1=data, Data2=cull_i)
xz = XZPlane(Origin=merge_3)
Y = UnitY(Factor=floor_height)
rectangle = Rectangle(Plane=xz, XSize=merge_2, YSize=Y, Radius=0)  # -> Rectangle, Length

# ----
# Extrusion
facade_extrusion = Slider(3, range=1..3)
neg = Negative(Value=facade_extrusion)
Y_2 = UnitY(Factor=neg)
rectangle_offset = Slider(0.88, range=0..1)
move = Move(Geometry=rectangle.Rectangle, Motion=Y_2)  # -> Geometry, Transform
extr = Extrude(Base=rectangle.Rectangle, Direction=Y_2)
xz_2 = XZPlane(Origin=Point(0, 0, 0))
neg_2 = Negative(Value=rectangle_offset)
offset = OffsetCurve(Curve=move.Geometry, Distance=neg_2, Plane=xz_2, Corners=1)
division_2 = Division(A=Y_2, B=2)
move_2 = Move(Geometry=offset, Motion=division_2)  # -> Geometry, Transform
offset_rectangles = Curve(simplify(graft(move_2.Geometry)))
main_rectangles = Curve(graft(move.Geometry))
facade_extrusion_2 = Geometry(extr)
glass_surface = Surface(offset_rectangles)
loft = Loft(
    Curves=[main_rectangles, offset_rectangles],
    Options={Adjust=False, Closed=False, LoftEnds=0, LoftSimp=0, LoftType=0, Rebuild=10, Refit=0.01})

# ----
# Visualization
number_slider = Slider(0.31, range=0..1)
material = CreateMaterial(
    Diffuse=ColourSwatch(SwatchColor=RGB(173, 173, 173)),
    Specular=RGB(255, 255, 255),
    Emission=RGB(0, 0, 0),
    Transparency=0,
    Shine=0)
material_2 = CreateMaterial(
    Diffuse=ColourSwatch(SwatchColor=RGB(162, 226, 242)),
    Specular=RGB(255, 255, 255),
    Emission=RGB(0, 0, 0),
    Transparency=number_slider,
    Shine=Slider(20, range=0..100))
preview = CustomPreview(Geometry=[loft, facade_extrusion_2], Material=material)
preview_2 = CustomPreview(Geometry=glass_surface, Material=material_2)
