# Grasshopper definition 023_WavedWall.gh (Grasshopper 1.0.7)
# plug-ins: Pufferfish, Bifocals, LunchBox

# ----
# Paneling
number_slider = Slider(600, range=0..1000)
X = UnitX(Factor=1)
line = LineSDL(Start="0,0,0", Direction=X, Length=number_slider)
Z = UnitZ(Factor=Slider(200, range=0..1000))
extr = Extrude(Base=line, Direction=Z)
quadstag = StaggeredQuadPanels(Surface=extr, UDivisions=Slider(4, range=0..100), VDivisions=Slider(20, range=0..100))
area = Area(Geometry=quadstag)  # -> Area, Centroid
sort = SortList(Keys=area.Area)  # -> Keys, ValuesA
int = Integer(area.Area)
int_2 = Integer(sort.Keys)
item = ListItem(List=int_2, Index=0, Wrap=True)
equals = Equality(FirstNumber=int, SecondNumber=item)  # -> Equality, Inequality
dispatch = Dispatch(List=quadstag, DispatchPattern=equals.Equality)  # -> ListA, ListB
geo = Geometry(dispatch.ListB)
geo_2 = Geometry(dispatch.ListA)

# ----
# Panel Design
# This part is inspired from:
# https://www.instagram.com/generativemaster/
item_2 = ListItem(List=geo, Index=0, Wrap=True)
item_3 = ListItem(List=geo_2, Index=0, Wrap=True)
debox = DeconstructBox(Box=item_2)  # -> Plane, X, Y, Z
debox_2 = DeconstructBox(Box=item_3)  # -> Plane, X, Y, Z
dedomain = DeconstructDomain(Domain=debox.X)  # -> Start, End
dedomain_2 = DeconstructDomain(Domain=debox.Z)  # -> Start, End
dedomain_3 = DeconstructDomain(Domain=debox_2.X)  # -> Start, End
dedomain_4 = DeconstructDomain(Domain=debox_2.Z)  # -> Start, End
expression = Expression(x=dedomain.End, y=dedomain_2.End, Expression="sqrt(x² + y²)")
subtraction = Subtraction(A=dedomain_3.Start, B=dedomain_3.End)
pt = ConstructPoint(XCoordinate=dedomain.End, YCoordinate=0, ZCoordinate=dedomain_2.End)
pt_2 = ConstructPoint(XCoordinate=subtraction, YCoordinate=0, ZCoordinate=dedomain_4.End)
radius = Number(expression)
number_slider_2 = Slider(200, range=0..1000)
pi = Pi(Factor=Slider(25, range=0..100))
range = Range(Domain=radius, Steps=number_slider_2)
range_2 = Range(Domain=pi, Steps=number_slider_2)
sin = Sine(Value=range_2)
multiplication = Multiplication(A=sin, B=Slider(0.673, range=0..1))
pt_3 = ConstructPoint(XCoordinate=range, YCoordinate=multiplication, ZCoordinate=0)
Y = UnitY(Factor=1)
line_2 = LineSDL(Start="0,0,0", Direction=Y, Length=1)
nurbs = NurbsCurve(Vertices=pt_3, Degree=3, Periodic=False)  # -> Curve, Length, Domain
revsrf = Revolution(Curve=nurbs.Curve, Axis=line_2, Domain=Domain(0, 6.283185307))

# ----
# Panel I
xz = XZPlane(Origin=Point(0, 0, 0))
rec_2pt = Rectangle2Pt(Plane=xz, PointA=pt, PointB="0,0,0", Radius=0)  # -> Rectangle, Length
Y_2 = UnitY(Factor=1)
project = Project(Curve=rec_2pt.Rectangle, Brep=revsrf, Direction=Y_2)
srfsplit = SurfaceSplit(Surface=revsrf, Curves=project)
item_4 = ListItem(List=srfsplit, Index=0, Wrap=True)
Y_3 = UnitY(Factor=Slider(1, range=0..3))
extr_2 = Extrude(Base=item_4, Direction=Y_3)

# ----
# Panel II
xz_2 = XZPlane(Origin=Point(0, 0, 0))
rec_2pt_2 = Rectangle2Pt(Plane=xz_2, PointA=pt_2, PointB="0,0,0", Radius=0)  # -> Rectangle, Length
Y_4 = UnitY(Factor=1)
project_2 = Project(Curve=rec_2pt_2.Rectangle, Brep=revsrf, Direction=Y_4)
srfsplit_2 = SurfaceSplit(Surface=revsrf, Curves=project_2)
item_5 = ListItem(List=srfsplit_2, Index=0, Wrap=True)
Y_5 = UnitY(Factor=Slider(1, range=0..3))
extr_3 = Extrude(Base=item_5, Direction=Y_5)

panel_2 = Geometry(geo_2)
panel_1 = Geometry(geo)
area_2 = Area(Geometry=panel_2)  # -> Area, Centroid
area_3 = Area(Geometry=panel_1)  # -> Area, Centroid

# ----
# Random Rotation
panel_1_2 = Geometry(extr_2)
panel_2_2 = Geometry(extr_3)
area_4 = Area(Geometry=panel_1_2)  # -> Area, Centroid
area_5 = Area(Geometry=panel_2_2)  # -> Area, Centroid
move2pt = MoveToPoint(Geometry=panel_1_2, PointA=area_4.Centroid, PointB=area_3.Centroid)  # -> Moved, Vector, Transform
move2pt_2 = MoveToPoint(Geometry=panel_2_2, PointA=area_5.Centroid, PointB=area_2.Centroid)  # -> Moved, Vector, Transform
lng = ListLength(List=move2pt.Moved)
lng_2 = ListLength(List=move2pt_2.Moved)
random = Random(Range=Domain(0, 1), Number=lng, Seed=2, Integers=True)
random_2 = Random(Range=Domain(0, 1), Number=lng_2, Seed=2, Integers=True)
python = GhPythonScript(my_nums=random)  # -> out, a; inputs my_nums: list of Int32
# ---------- python: Python ----------
__author__ = "burke"
__version__ = "2026.02.18"

import rhinoscriptsyntax as rs

for x in my_nums:
    if x == 0:
        print(0)
    elif x == 1:
        print(180)
# ---------- end python ----------
python_2 = GhPythonScript(my_nums=random_2)  # -> out, a; inputs my_nums: list of Int32; same code as python
area_6 = Area(Geometry=move2pt.Moved)  # -> Area, Centroid
area_7 = Area(Geometry=move2pt_2.Moved)  # -> Area, Centroid
xz_3 = XZPlane(Origin=area_6.Centroid)
xz_4 = XZPlane(Origin=area_7.Centroid)
rotate = Rotate(Geometry=move2pt.Moved, Angle=degrees(python.out), Plane=xz_3)  # -> Geometry, Transform
rotate_2 = Rotate(Geometry=move2pt_2.Moved, Angle=degrees(python_2.out), Plane=xz_4)  # -> Geometry, Transform

merge = Merge(Data1=rotate.Geometry, Data2=rotate_2.Geometry)
preview = CustomPreview(Geometry=merge, Material=ColourSwatch(SwatchColor=RGB(196, 196, 196)))
