# Grasshopper definition 024_EllipticalAttractorFacade.gh (Grasshopper 1.0.7)
# plug-ins: Bifocals

# ----
# Base Curve
attractor_point = Slider(100, range=1..200)
base_curve_length = Slider(25, range=1..50)
phi = GoldenRatio(Factor=base_curve_length)
ellipse = Ellipse(Plane=PlaneXY(0, 0, 0), Radius1=phi, Radius2=base_curve_length)  # -> Ellipse, Focus1, Focus2
neg = Negative(Value=attractor_point)
pt = ConstructPoint(XCoordinate=neg, YCoordinate=0, ZCoordinate=0)
base_curve = Curve(reparameterize(ellipse.Ellipse))

floorheight = Slider(5, range=4..5)
numberoffloors = Slider(30, range=1..40)

# ---- group: Attractor Domain
number_slider = Slider(10, range=0..10)
number_slider_2 = Slider(6, range=0..10)

# ----
# Panel Logic
number_of_panels = Slider(45, range=0..100)
divide = DivideCurve(Curve=base_curve, Count=number_of_panels, Kinks=False)  # -> Points, Tangents, Parameters
dist = Distance(PointA=divide.Points, PointB=pt)
bnd = Bounds(Numbers=dist)
dom = ConstructDomain(DomainStart=number_slider, DomainEnd=number_slider_2)
len = Length(Curve=base_curve)
remap = RemapNumbers(Value=dist, Source=bnd, Target=dom)  # -> Mapped, Clipped
ma = MassAddition(Input=remap.Mapped)  # -> Result, PartialResults
division = Division(A=len, B=ma.Result)
multiplication = Multiplication(A=remap.Mapped, B=division)
division_2 = Division(A=multiplication, B="2")
ma_2 = MassAddition(Input=multiplication)  # -> Result, PartialResults
neg_2 = Negative(Value=division_2)
eval = EvaluateLength(Curve=base_curve, Length=ma_2.PartialResults, Normalized=False)  # -> Point, Tangent, Parameter
dom_2 = ConstructDomain(DomainStart=neg_2, DomainEnd=division_2)
Z = UnitZ(Factor=1)
number_of_floors = Number(numberoffloors)
floor_height = Number(floorheight)
pl = ConstructPlane(Origin=eval.Point, XAxis=eval.Tangent, YAxis=Z)
rectangle = Rectangle(Plane=pl, XSize=dom_2, YSize=floor_height, Radius=0)  # -> Rectangle, Length

# ----
# Panel Rotation
glass_offset = Slider(0.6, range=0..10)
neg_3 = Negative(Value=glass_offset)
offset = OffsetCurve(Curve=rectangle.Rectangle, Distance=neg_3, Corners=1)
explode = Explode(Curve=offset, Recursive=True)  # -> simplify(Segments), Vertices
item = ListItem(List=explode.Segments, Index=Slider(3, range=0..3), Wrap=True)
rotax = RotateAxis(Geometry=offset, Angle=degrees(Slider(20, range=0..90)), Axis=item)  # -> simplify(flatten(Geometry)), Transform
base_curves = Curve(rectangle.Rectangle)

# ----
# Floor Multiplication
entwine = Entwine(Branch00=base_curves, Branch01=rotax.Geometry, FlattenInputs=True)
series = Series(Start=0, Step=floor_height, Count=number_of_floors)
flip = FlipMatrix(Data=entwine)  # -> simplify(Data)
base_curve_2 = Curve(reparameterize(base_curve))
loft = Loft(Curves=flip, Options={Adjust=False, Closed=False, LoftEnds=0, LoftSimp=0, LoftType=0, Rebuild=10, Refit=0.01})
crv = Curve(rotax.Geometry)
glass_surface = Surface(crv)
addition = Addition(A=series, B=floor_height)
Z_2 = UnitZ(Factor=series)
Z_3 = UnitZ(Factor=addition)
move = Move(Geometry=graft(glass_surface), Motion=Z_2)  # -> Geometry, Transform
move_2 = Move(Geometry=base_curve_2, Motion=Z_3)  # -> Geometry, Transform
move_3 = Move(Geometry=loft, Motion=Z_2)  # -> Geometry, Transform
srf = Surface([move_2.Geometry, base_curve_2])

# ----
# Visualization
number_slider_3 = Slider(0.3, range=0..1)
swatch = ColourSwatch(SwatchColor=RGB(94, 255, 255))
material = CreateMaterial(
    Diffuse=ColourSwatch(SwatchColor=RGB(201, 201, 201)),
    Specular=RGB(255, 255, 255),
    Emission=RGB(0, 0, 0),
    Transparency=0,
    Shine=0)
material_2 = CreateMaterial(
    Diffuse=ColourSwatch(SwatchColor=RGB(201, 201, 201)),
    Specular=RGB(255, 255, 255),
    Emission=RGB(0, 0, 0),
    Transparency=0,
    Shine=Slider(60, range=0..100))
material_3 = CreateMaterial(
    Diffuse=swatch,
    Specular=RGB(255, 255, 255),
    Emission=swatch,
    Transparency=number_slider_3,
    Shine=Slider(20, range=0..100))
preview = CustomPreview(Geometry=move_3.Geometry, Material=material_2)
preview_2 = CustomPreview(Geometry=move.Geometry, Material=material_3)
preview_3 = CustomPreview(Geometry=srf, Material=material)
