# Grasshopper definition 025_PolygonFacade.gh (Grasshopper 1.0.7)
# Copyright: MIT license
# plug-ins: Bifocals, Pufferfish

polygonradius = Slider(40, range=0..100)
filletradius = Slider(5, range=0..10)
polygon = Polygon(Plane=PlaneXY(0, 0, 0), Radius=polygonradius, Segments=6, FilletRadius=0)  # -> Polygon, Length
scale_nu = ScaleNU(Geometry=polygon.Polygon, Plane=PlaneXY(0, 0, 0), ScaleX=1, ScaleY=Slider(4, range=1..10), ScaleZ=1)  # -> Geometry, Transform
division = Division(A=polygonradius, B=filletradius)
x_array = Slider(10, range=0..100)
fillet = Fillet(Curve=scale_nu.Geometry, Radius=division)
multiplication = Multiplication(A=polygonradius, B="3")
multiplication_2 = Multiplication(A=polygonradius, B="1.5")
series = Series(Start=multiplication, Step=multiplication, Count=x_array)
explode = Explode(Curve=fillet, Recursive=True)  # -> Segments, Vertices
pt = ConstructPoint(XCoordinate=multiplication_2, YCoordinate=0, ZCoordinate=0)
item = ListItem(List=explode.Segments, Index=Slider(9, range=0..10), Wrap=True)
X = UnitX(Factor=series)
midpt = CurveMiddle(Curve=item)
move = Move(Geometry=fillet, Motion=X)  # -> Geometry, Transform
vec2pt = Vector2Pt(PointA=midpt, PointB=pt, Unitize=False)  # -> Vector, Length
merge = Merge(Data1=fillet, Data2=move.Geometry)  # -> flatten(Result)
move_2 = Move(Geometry=merge, Motion=vec2pt.Vector)  # -> flatten(Geometry), Transform
offset_outer = Slider(10, range=0..10)
offset_inner = Slider(5, range=0..10)
merge_2 = Merge(Data1=merge, Data2=move_2.Geometry)
number_slider = Slider(2, range=0..10)
neg = Negative(Value=offset_inner)
neg_2 = Negative(Value=offset_outer)
offset = OffsetCurve(Curve=merge_2, Distance=neg, Corners=number_slider)  # -> flatten(Curve)
extrusion_length = Slider(8, range=0..10)
offset_2 = OffsetCurve(Curve=merge_2, Distance=neg_2, Corners=number_slider)  # -> flatten(Curve)
crv = Curve(flatten(merge_2))
Z = UnitZ(Factor=extrusion_length)
move_3 = Move(Geometry=offset, Motion=Z)  # -> Geometry, Transform
merge_3 = Merge(Data1=graft(move_3.Geometry), Data2=graft(crv))
merge_4 = Merge(Data1=graft(move_3.Geometry), Data2=graft(offset_2))
loft = Loft(Curves=merge_4, Options={Adjust=False, Closed=False, LoftEnds=0, LoftSimp=0, LoftType=0, Rebuild=10, Refit=0.01})
loft_2 = Loft(Curves=merge_3, Options={Adjust=False, Closed=False, LoftEnds=0, LoftSimp=0, LoftType=0, Rebuild=10, Refit=0.01})
tstat = TreeStatistics(Tree=loft)  # -> Paths, Length, Count
item_2 = ListItem(List=tstat.Paths, Index=-1, Wrap=True)
split = SplitTree(Data=[loft, loft_2], Masks=flatten(item_2))  # -> Positive, Negative
geo = Geometry(split.Negative)
X_2 = UnitX(Factor=1)
brec = BoundingRectangle(Geometry=merge, Plane=PlaneXY(0, 0, 0), Axis=0, Slide=0, Union=True)  # -> Bounding, DimensionX, DimensionY
rot3d = Rotate3D(Geometry=geo, Angle=degrees("90"), Center=Point(0, 0, 0), Axis=X_2)  # -> Geometry, Transform
z_array = Slider(4, range=0..10)
neg_3 = Negative(Value=Slider(50, range=0..100))
join = BrepJoin(Breps=rot3d.Geometry)  # -> Breps, Closed
series_2 = Series(Start=brec.DimensionY, Step=brec.DimensionY, Count=z_array)
Z_2 = UnitZ(Factor=series_2)
dom = ConstructDomain(DomainStart=Slider(100, range=0..100), DomainEnd=Slider(1200, range=0..10000))
dom_2 = ConstructDomain(DomainStart=neg_3, DomainEnd=brec.DimensionX)
rectangle = Rectangle(Plane=PlaneXY(0, 0, 0), XSize=dom_2, YSize=dom, Radius=0)  # -> Rectangle, Length
move_4 = Move(Geometry=simplify(join.Breps), Motion=Z_2)  # -> Geometry, Transform
Z_3 = UnitZ(Factor=Slider(1250, range=0..10000))
material = CreateMaterial(
    Diffuse=ColourSwatch(SwatchColor=RGB(186, 186, 186)),
    Specular=RGB(255, 255, 255),
    Emission=RGB(0, 0, 0),
    Transparency=0,
    Shine=Slider(5, range=0..100))
extr = Extrude(Base=rectangle.Rectangle, Direction=Z_3)
cap = CapHoles(Brep=extr)
preview = CustomPreview(Geometry=move_4.Geometry, Material=material)
